# Grasshopper definition Colour_schemes.gh (Grasshopper 1.0.7)

colour_swatch = ColourSwatch(SwatchColor=RGB(0, 156, 240))
colour_swatch_2 = ColourSwatch(SwatchColor=RGB(255, 135, 84))
colour_swatch_3 = ColourSwatch(SwatchColor=RGB(5, 51, 110))
colour_swatch_4 = ColourSwatch(SwatchColor=RGB(97, 41, 74))
colour_swatch_5 = ColourSwatch(SwatchColor=RGB(204, 236, 252))
colour_swatch_6 = ColourSwatch(SwatchColor=RGB(224, 213, 220))
colour_swatch_7 = ColourSwatch(SwatchColor=RGB(0, 156, 240))
colour_swatch_8 = ColourSwatch(SwatchColor=RGB(97, 41, 74))
colour_swatch_9 = ColourSwatch(SwatchColor=RGB(204, 236, 252))
colour_swatch_10 = ColourSwatch(SwatchColor=RGB(18, 89, 63))
colour_swatch_11 = ColourSwatch(SwatchColor=RGB(209, 222, 217))
colour_swatch_12 = ColourSwatch(SwatchColor=RGB(0, 156, 240))
colour_swatch_13 = ColourSwatch(SwatchColor=RGB(0, 156, 240))
colour_swatch_14 = ColourSwatch(SwatchColor=RGB(209, 222, 217))
colour_swatch_15 = ColourSwatch(SwatchColor=RGB(5, 51, 110))
colour_swatch_16 = ColourSwatch(SwatchColor=RGB(18, 89, 63))
gradient = Gradient(LowerLimit=0, UpperLimit=1, stops=[0: RGB(97, 41, 74), 0.5: RGB(255, 135, 84), 1: RGB(255, 230, 130)])
gradient_2 = Gradient(LowerLimit=0, UpperLimit=1, stops=[0: RGB(18, 89, 63), 0.5: RGB(5, 51, 110), 1: RGB(0, 156, 240)])
file_path = FilePath("C:\Users\AOMAN\OneDrive - Ramboll\Documents\ColourSchemes\CyanandHealth.png")
file_path_2 = FilePath("C:\Users\AOMAN\OneDrive - Ramboll\Documents\ColourSchemes\CyanandForest.png")
file_path_3 = FilePath("C:\Users\AOMAN\OneDrive - Ramboll\Documents\ColourSchemes\Ocan_cyan_health_field.png")
file_path_4 = FilePath("C:\Users\AOMAN\OneDrive - Ramboll\Documents\ColourSchemes\Ocean_cyan_forest_grass.png")
image_resource = ImageResource(file_path)
# Highrise_UK
# ColourScheme
image_resource_2 = ImageResource(file_path_2)
image_resource_3 = ImageResource(file_path_3)
image_resource_4 = ImageResource(file_path_4)
gradient_3 = Gradient(
    LowerLimit=0,
    UpperLimit=1,
    stops=[0: RGB(18, 89, 63), 0.204: RGB(5, 51, 110), 0.403: RGB(0, 156, 240), 0.601: RGB(97, 41, 74), 0.804: RGB(255, 135, 84), 1: RGB(255, 230, 130)])
file_path_5 = FilePath("C:\Users\AOMAN\OneDrive - Ramboll\Documents\ColourSchemes\Forest_cyan_health.png")
file_path_6 = FilePath("C:\Users\AOMAN\OneDrive - Ramboll\Documents\ColourSchemes\Cyan_to_health.png")
file_path_7 = FilePath("C:\Users\AOMAN\OneDrive - Ramboll\Documents\ColourSchemes\Grass_Cyan_Health.png")
image_resource_5 = ImageResource(file_path_5)
image_resource_6 = ImageResource(file_path_6)
image_resource_7 = ImageResource(file_path_7)
colour_swatch_17 = ColourSwatch(SwatchColor=RGB(18, 89, 63))
colour_swatch_18 = ColourSwatch(SwatchColor=RGB(0, 156, 240))
colour_swatch_19 = ColourSwatch(SwatchColor=RGB(97, 41, 74))
colour_swatch_20 = ColourSwatch(SwatchColor=RGB(174, 209, 151))
colour_swatch_21 = ColourSwatch(SwatchColor=RGB(0, 156, 240))
colour_swatch_22 = ColourSwatch(SwatchColor=RGB(97, 41, 74))
colour_swatch_23 = ColourSwatch(SwatchColor=RGB(5, 51, 110))
colour_swatch_24 = ColourSwatch(SwatchColor=RGB(0, 156, 240))
colour_swatch_25 = ColourSwatch(SwatchColor=RGB(97, 41, 74))
