# Grasshopper definition Template_Polygonal_grid.gh (Grasshopper 1.0.7)
# plug-ins: MetaHopper

karamba = ColourSwatch(SwatchColor=RGBA(149, 209, 46, 95))

# ---- group: Background_color_change
changebackground = GhPythonScript(
    change=Toggle(True),
    newBackgroundColor=ColourSwatch(SwatchColor=RGB(207, 202, 202)),
    wireColor=RGB(110, 110, 110),
    selectedWireColor=RGB(47, 255, 0))  # inputs newBackgroundColor: Color, wireColor: Color, selectedWireColor: Color
# ---------- changebackground: Python ----------
import Grasshopper as gh
import rhinoscriptsyntax as rs

newShadeColor = rs.CreateColor(0,0,0,20)
newEdgeColor = rs.CreateColor(0,0,0,40)

if(change):
     gh.GUI.Canvas.GH_Skin.canvas_back = newBackgroundColor
     gh.GUI.Canvas.GH_Skin.canvas_shade = newShadeColor
     gh.GUI.Canvas.GH_Skin.canvas_edge = newEdgeColor
     gh.GUI.Canvas.GH_Skin.wire_default = wireColor
     gh.GUI.Canvas.GH_Skin.wire_selected_a = selectedWireColor
     gh.GUI.Canvas.GH_Skin.wire_selected_b = selectedWireColor
# ---------- end changebackground ----------

# ----
recolor_all = Button()
unused = ColourSwatch(SwatchColor=RGBA(250, 192, 125, 150))

# ---- group: Auto_color
in = ColourSwatch(SwatchColor=RGBA(255, 231, 54, 150))
analysis = ColourSwatch(SwatchColor=RGBA(232, 224, 255, 150))
out = ColourSwatch(SwatchColor=RGBA(255, 189, 189, 150))
visual = ColourSwatch(SwatchColor=RGBA(156, 255, 215, 150))
colorgroups = CSharpScript(Colors=[in, analysis, out, visual, unused, karamba], Enable=Toggle(True), Rename=False, RunOnce=recolor_all, Debug=False)  # -> out; inputs Colors: list of Color, Enable: Boolean, Rename: Boolean, RunOnce: Boolean, Debug: Boolean
# ---------- colorgroups: C# usings ----------
using System.Linq;
using System.Text;
using System.Reflection;
# ---------- colorgroups: C# ----------
    msg.Clear();

    
    this.Component.Message = "id: " + id.ToString();

    _debug = Debug; //Set to true to have all events printed in rhino log
    _rename = Rename;

    if (Enable)
    {
      msg.AppendFormat("Set up events on ID {0}\n", id);
      SetupDict(); // Create a dictionary of the input swatches
      SetEventHandlers(); // This would do the job.


    }
    else
    {
      RemoveEventHandlers();
    }
    if (RunOnce)
    {
      foreach(Grasshopper.Kernel.Special.GH_Group grp in Grasshopper.Instances.ActiveCanvas.Document.Objects.OfType<Grasshopper.Kernel.Special.GH_Group>())
      {
        ColorGroup(grp, null); // You decide if it should run once on all existing groups

      }
    }

    Print(msg.ToString());


    // Component setup
    Component.Description = "Set up event handlers to color groups based on prefixes such as 'in_' and 'out_'.\n"
      + "Please insert only swatcheds directly into the Colors input\n\n"
      + "MIT License. Copyright Mathias Sønderskov Schaltz 2022";
    Component.Params.Input[0].Description = "Please insert only swatcheds directly into the Colors input.\nRemember to rename them";
    Component.Params.Input[1].Description = "Toggle to run...";
    Component.Params.Input[2].Description = "Set to true if you want to automatically rename the groups and remove prefix. Default is false.";
    Component.Params.Input[3].Description = "Set to true to run it once and color all existing groups.";
    Component.Params.Input[Component.Params.Input.Count - 1].Description = "Set debug to true to get all the events printed in the rhino log";
# ---------- colorgroups: C# additional code ----------
  public static Random rnd = new Random();
  public int id = rnd.Next(0, 1000);
  StringBuilder msg = new StringBuilder();
  Dictionary<string, System.Drawing.Color> colorDict = new Dictionary<string, System.Drawing.Color>();

  bool _debug = false;
  bool _rename = false;

  public bool IdExists(int id)
  {
    IList<IGH_DocumentObject> objs = Grasshopper.Instances.ActiveCanvas.Document.Objects;
    return objs
      .OfType<IGH_Component>()
      .Where(ob => ob.NickName == this.Component.NickName)
      .Where(ob => ob.GetType().ToString() == "ScriptComponents.Component_CSNET_Script")
      .Where(ob => ob.Message == "id: " + id.ToString()).Any();

  }


  public void SetupDict()
  {
    colorDict.Clear();
    // Get all inputs to "Colors"
    IList<IGH_Param> colorSources = this.Component.Params.Input[0].Sources;
    if (colorSources.Count == 0)
    {
      throw new Exception("You forgot to setup the colors. Please input swatch components and rename them");
    }
    foreach(IGH_Param source in colorSources)
    {
      //if (source.Type.ToString() == "Grasshopper.Kernel.Types.GH_Colour")
      if (source is Grasshopper.Kernel.Special.GH_ColourSwatch)
      {
        string nickName = source.NickName.Split('_')[0].Trim() + "_";
        if(!colorDict.ContainsKey(nickName))
        {
          Grasshopper.Kernel.Special.GH_ColourSwatch swatch = (Grasshopper.Kernel.Special.GH_ColourSwatch) source;
          colorDict.Add(nickName, swatch.SwatchColour);
        }
        else
        {
          throw new Exception("Multiple swatches using the same name detected. Please rename");
        }
      }
      else
      {
        throw new Exception("Whacko! Why did you input a non-swatch into the Colors? " + source.Type.ToString());
      }

    }

    msg.AppendFormat("Set up the dictionaries with {0} colors\n", colorDict.Count);
    foreach(var pairs in colorDict)
    {
      msg.AppendFormat("{0} -> {1}\n", ("\"" + pairs.Key + "\"").PadRight(5 + colorDict.Keys.Select(k => k.Length).Max()), pairs.Value);
    }
  }

  public void SetEventHandlers()
  {

    // Always remove events first to avoid duplicates
    GrasshopperDocument.ObjectsAdded -= OnObjectsAdded;
    GrasshopperDocument.ObjectsDeleted -= OnObjectsRemoved;
    GrasshopperDocument.ObjectsDeleted -= OnDeleteThisComponent;

    // Attach events
    GrasshopperDocument.ObjectsAdded += OnObjectsAdded;
    GrasshopperDocument.ObjectsDeleted += OnObjectsRemoved;
    GrasshopperDocument.ObjectsDeleted += OnDeleteThisComponent;


    foreach(Grasshopper.Kernel.Special.GH_Group grp in GrasshopperDocument.Objects.OfType<Grasshopper.Kernel.Special.GH_Group>())
    {
      grp.ObjectChanged -= ColorGroup;
      grp.ObjectChanged += ColorGroup;

      //ColorGroup(grp, null); // Make sure to run it once
    }
    msg.AppendFormat("Added the eventhandlers on {0} existing groups and on future created groups\n", GrasshopperDocument.Objects.OfType<Grasshopper.Kernel.Special.GH_Group>().Count());
  }

  public void OnObjectsAdded(object sender, GH_DocObjectEventArgs e)
  {
    bool any = false;
    foreach (Grasshopper.Kernel.Special.GH_Group grp in e.Objects.OfType<Grasshopper.Kernel.Special.GH_Group>())
    {
      grp.ObjectChanged -= ColorGroup;
      grp.ObjectChanged += ColorGroup;
      any = true;
    }

    DebugWrite(any ? "Group Objects Added: Attaching Events to ObjectChanged" : "Objects Added - but no groups");
  }

  //Same but reversed
  public void OnObjectsRemoved(object sender, GH_DocObjectEventArgs e)
  {
    bool any = false;
    foreach (Grasshopper.Kernel.Special.GH_Group grp in e.Objects.OfType<Grasshopper.Kernel.Special.GH_Group>())
    {
      grp.ObjectChanged -= ColorGroup;
      any = true;
    }

    DebugWrite(any ? "Group Objects Removed, removing event" : "Objects Removed - although not a group");

  }



  public void RemoveEventHandlers()
  {
    GrasshopperDocument.ObjectsAdded -= OnObjectsAdded;
    GrasshopperDocument.ObjectsDeleted -= OnObjectsRemoved;


    foreach(Grasshopper.Kernel.Special.GH_Group grp in GrasshopperDocument.Objects.OfType<Grasshopper.Kernel.Special.GH_Group>())
    {
      grp.ObjectChanged -= ColorGroup;

    }
    msg.AppendFormat("Removed event handlers on document and on {0} groups\n", GrasshopperDocument.Objects.OfType<Grasshopper.Kernel.Special.GH_Group>().Count());

  }

  public void ColorGroup(object sender, EventArgs e)
  {
    if (!IdExists(id))
    {
      DebugWrite("Component not relevant. Disabling old id + " + id.ToString());
      RemoveEventHandlers();
      return;
    }

    Grasshopper.Kernel.Special.GH_Group grp = sender as Grasshopper.Kernel.Special.GH_Group;
    if (grp == null) return; //not type GH_Group
    //if (!grp.NickName.EndsWith("_")) return;

    string[] nameParts = grp.NickName.Split('_');
    if (nameParts.Length <= 1)
      return;
    string prefix = grp.NickName.Split('_')[0].Trim() + '_';

    string prefixes = String.Join(", ", colorDict.Keys.Select(k => "\"" + k + "\""));

    msg.Append("prefix " + prefix + "\n");
    if (colorDict.ContainsKey(prefix))
    {
      //if (grp.NickName.EndsWith("_"))
      grp.Colour = colorDict[prefix];
      if (_rename)
      {
        grp.NickName = grp.NickName.Replace(prefix, "");
      }

      DebugWrite("Colored " + grp.NickName);

    }
    else
    {
      DebugWrite("Group changed but not relevant: prefix " + prefix + " is not among " + prefixes);
    }

  }
  public void DebugWrite(string msg)
  {
    if (_debug)
    {
      Rhino.RhinoApp.WriteLine(String.Format("[ColGrps {0}]: {1}", id, msg));
    }
  }

  public void OnDeleteThisComponent(object sender, GH_DocObjectEventArgs e)
  {

    if (e.Objects.OfType<Grasshopper.Kernel.GH_Component>().Where(o => o.NickName == this.Component.NickName).Any())
    {
      DebugWrite("Removed template component. Removing all the eventhandlers");
      RemoveEventHandlers();
    }

  }
# ---------- end colorgroups ----------
panel = Panel(colorgroups)

# ---- group: in_
side_to_orient_grid = Slider(3, range=0..10)
number_to_divide_the_module_area = Slider(3, range=2..5)
grid_size_in_m = Slider(1.2, range=0.6..2.2)
# Input Information
# 1. Planar_Outline : Reference the Planar polygonal outline to generate the grid
# 2. Grid Size : Desired size of the grid
# 3. Side_to_orient_Grid : The grid will be oriented to the selected side
# 4. Number_to_divide_the_module_area : This is a tolerance value for merging cells, increasing this number will allow for more smaller cells
planar_outline = Curve(<curve referenced from the Rhino model>)

# ----
unit_y = UnitY(Factor=1)

# ---- group: Plugins_Used
# Brief Description: This Script is developed to make an orthogonal grid on any Polygonal shaped Bouundary which is a common problem faced in structural design.
# Versioning: Please update the version when you make a change
# Version 1 : 21062022
document_info = DocumentInfo(AutoUpdate=False, Recursive=False)  # -> DocumentName, DocumentFilePath, Components, Params, _3rdPartyAssemblies
list_of_plugins_used = Panel(document_info._3rdPartyAssemblies)

# ---- group: analysis_ / in_
grid_size = Data(grid_size_in_m)

# ---- group: analysis_
# Make the base Grid
deconstruct_brep = DeconstructBrep(Brep=planar_outline)  # -> Faces, Edges, Vertices
area = Area(Geometry=planar_outline)  # -> Area, Centroid
list_item = ListItem(List=deconstruct_brep.Edges, Index=side_to_orient_grid, Wrap=True)
panel_2 = Panel("Selected_Segment")
end_points = EndPoints(Curve=list_item)  # -> Start, End
dimensions = Dimensions(Surface=planar_outline)  # -> UDimension, VDimension
vector_2pt = Vector2Pt(PointA=end_points.Start, PointB=end_points.End, Unitize=False)  # -> Vector, Length
line_sdl = LineSDL(Start=end_points.Start, Direction=vector_2pt.Vector, Length=1)
contour = Contour(Shape=planar_outline, Point=end_points.Start, Direction=line_sdl, Distance=grid_size_in_m)
length = Length(Curve=contour)  # -> flatten(Length)
smaller_than = SmallerThan(FirstNumber=length, SecondNumber=expr("x", grid_size_in_m))  # -> SmallerThan, OrEqualTo
cull_pattern = CullPattern(List=flatten(contour), CullPattern=invert(smaller_than.SmallerThan))

# ----
offset_curve = OffsetCurve(Curve=list_item, Distance=1, Corners=1)
curve_middle = CurveMiddle(Curve=list_item)

# ---- group: analysis_ (continued)
end_points_2 = EndPoints(Curve=offset_curve)  # -> Start, End
vector_2pt_2 = Vector2Pt(PointA=end_points.Start, PointB=end_points_2.Start, Unitize=False)  # -> Vector, Length
line_sdl_2 = LineSDL(Start=end_points.Start, Direction=vector_2pt_2.Vector, Length=1)
contour_2 = Contour(Shape=planar_outline, Point=end_points.Start, Direction=line_sdl_2, Distance=grid_size_in_m)
construct_plane = ConstructPlane(Origin=end_points.Start, XAxis=line_sdl, YAxis=line_sdl_2)
length_2 = Length(Curve=contour_2)  # -> flatten(Length)
smaller_than_2 = SmallerThan(FirstNumber=length_2, SecondNumber=expr("x", grid_size_in_m))  # -> SmallerThan, OrEqualTo
cull_pattern_2 = CullPattern(List=flatten(contour_2), CullPattern=invert(smaller_than_2.SmallerThan))
surface_split = SurfaceSplit(Surface=planar_outline, Curves=[cull_pattern, cull_pattern_2])

# ----
text_tag_3d = TextTag3D(Location=curve_middle, Text=panel_2, Size=1, Justification=7)
move = Move(Geometry=end_points.Start, Motion=unit_y)  # -> Geometry, Transform

# ---- group: analysis_
# Topology Neighbour check
brep_join = BrepJoin(Breps=flatten(surface_split))  # -> Breps, Closed
deconstruct_brep_2 = DeconstructBrep(Brep=brep_join.Breps)  # -> Faces, Edges, Vertices
brep_topology = BrepTopology(Brep=brep_join.Breps, PerspectiveOnly=False)  # -> FaceFaceAdjacency, FaceEdgeAdjacency, EdgeFaceAdjacency
rectangle = Rectangle(Plane=PlaneXY(0, 0, 0), XSize=grid_size, YSize=grid_size, Radius=0)  # -> Rectangle, Length
area_2 = Area(Geometry=deconstruct_brep_2.Faces)  # -> Area, Centroid
list_item_2 = ListItem(List=deconstruct_brep_2.Faces, Index=brep_topology.FaceFaceAdjacency, Wrap=True)
area_3 = Area(Geometry=rectangle.Rectangle)  # -> Area, Centroid
param_viewer = ParamViewer(list_item_2)
list_length = ListLength(List=deconstruct_brep_2.Faces)
division = Division(A=area_3.Area, B=number_to_divide_the_module_area)
series = Series(Start=0, Step=1, Count=list_length)
smaller_than_3 = SmallerThan(FirstNumber=area_2.Area, SecondNumber=division)  # -> SmallerThan, OrEqualTo

# Topology Neighbour check
cull_pattern_3 = CullPattern(List=deconstruct_brep_2.Faces, CullPattern=smaller_than_3.SmallerThan)
cull_pattern_4 = CullPattern(List=series, CullPattern=smaller_than_3.SmallerThan)
list_item_3 = ListItem(List=param_viewer, Index=cull_pattern_4, Wrap=True)
tree_branch = TreeBranch(Tree=brep_topology.FaceFaceAdjacency, Path=list_item_3, MaintainPaths=True)
tree_branch_2 = TreeBranch(Tree=list_item_2, Path=list_item_3, MaintainPaths=True)
area_4 = Area(Geometry=tree_branch_2)  # -> Area, Centroid
smaller_than_4 = SmallerThan(FirstNumber=area_4.Area, SecondNumber=division)  # -> SmallerThan, OrEqualTo
cull_pattern_5 = CullPattern(List=tree_branch, CullPattern=invert(smaller_than_4.SmallerThan))
cull_pattern_6 = CullPattern(List=tree_branch_2, CullPattern=invert(smaller_than_4.SmallerThan))
area_5 = Area(Geometry=cull_pattern_6)  # -> Area, Centroid
sort_list = SortList(Keys=area_5.Area, ValuesValuesA=cull_pattern_6)  # -> Keys, ValuesValuesA
sort_list_2 = SortList(Keys=area_5.Area, ValuesValuesA=cull_pattern_5)  # -> Keys, ValuesValuesA
list_item_4 = ListItem(List=sort_list_2.ValuesValuesA, Index=0, Wrap=True)  # -> Item1, Item
list_item_5 = ListItem(List=sort_list.ValuesValuesA, Index=0, Wrap=True)  # -> Item1, Item
create_set = CreateSet(List=flatten(list_item_4.Item1))  # -> Set, Map
geometry = Geometry(simplify(flatten(list_item_5.Item1)))

# Get grid cells
equality = Equality(FirstNumber=graft(create_set.Set), SecondNumber=flatten(list_item_4.Item1))  # -> Equality, Inequality
merge = Merge(Data1=create_set.Set, Data2=cull_pattern_4)
cull_pattern_7 = CullPattern(List=flatten(geometry), CullPattern=equality.Equality)  # -> simplify(List)
cull_pattern_8 = CullPattern(List=flatten(cull_pattern_3), CullPattern=equality.Equality)  # -> simplify(List)
create_set_2 = CreateSet(List=flatten(merge))  # -> Set, Map
list_item_6 = ListItem(List=cull_pattern_7, Index=0, Wrap=True)
cull_index = CullIndex(List=deconstruct_brep_2.Faces, Indices=create_set_2.Set, Wrap=True)
brep_join_2 = BrepJoin(Breps=[list_item_6, cull_pattern_8])  # -> Breps, Closed
merge_2 = Merge(Data1=flatten(cull_index), Data2=flatten(brep_join_2.Breps))
curve = Curve(merge_2)
area_6 = Area(Geometry=curve)  # -> Area, Centroid

# Create Cell centerlines ( Logic is just made  can modify if needed )
contour_3 = Contour(Shape=planar_outline, Point=end_points.Start, Direction=line_sdl, Distance=expr("x/2", grid_size_in_m))  # -> flatten(Contours)
contour_4 = Contour(Shape=planar_outline, Point=end_points.Start, Direction=line_sdl_2, Distance=expr("x/2", grid_size_in_m))  # -> flatten(Contours)
panel_3 = Panel("""True
False""")
panel_4 = Panel("""False
True""")
grid_size_2 = Data(grid_size_in_m)
cull_pattern_9 = CullPattern(List=contour_3, CullPattern=panel_3)  # -> graft(List)
cull_pattern_10 = CullPattern(List=contour_4, CullPattern=panel_4)  # -> graft(List)
curve_closest_point = CurveClosestPoint(Point=area_6.Centroid, Curve=cull_pattern_10)  # -> Point, Parameter, Distance
curve_closest_point_2 = CurveClosestPoint(Point=area_6.Centroid, Curve=cull_pattern_9)  # -> Point, Parameter, Distance
smaller_than_5 = SmallerThan(FirstNumber=curve_closest_point.Distance, SecondNumber=expr("x*0.5", grid_size_2))  # -> SmallerThan, OrEqualTo
smaller_than_6 = SmallerThan(FirstNumber=curve_closest_point_2.Distance, SecondNumber=expr("x*0.5", grid_size_2))  # -> SmallerThan, OrEqualTo
cull_pattern_11 = CullPattern(List=area_6.Centroid, CullPattern=smaller_than_5.SmallerThan)
cull_pattern_12 = CullPattern(List=curve_closest_point.Parameter, CullPattern=smaller_than_5.SmallerThan)
cull_pattern_13 = CullPattern(List=area_6.Centroid, CullPattern=smaller_than_6.SmallerThan)
sort_list_3 = SortList(Keys=cull_pattern_12, ValuesValuesA=cull_pattern_11)  # -> Keys, ValuesValuesA
cull_pattern_14 = CullPattern(List=curve_closest_point_2.Parameter, CullPattern=smaller_than_6.SmallerThan)
sort_list_4 = SortList(Keys=cull_pattern_14, ValuesValuesA=cull_pattern_13)  # -> Keys, ValuesValuesA
polyline = PolyLine(Vertices=sort_list_3.ValuesValuesA, Closed=False)
polyline_2 = PolyLine(Vertices=sort_list_4.ValuesValuesA, Closed=False)
diagonal_two_axis = Geometry(polyline)
end_points_3 = EndPoints(Curve=diagonal_two_axis)  # -> Start, End
diagonal_one_axis = Geometry(polyline_2)
line = Line(StartPoint=end_points_3.Start, EndPoint=end_points_3.End)
end_points_4 = EndPoints(Curve=diagonal_one_axis)  # -> Start, End
line_2 = Line(StartPoint=end_points_4.Start, EndPoint=end_points_4.End)
curve_closest_point_3 = CurveClosestPoint(Point=sort_list_3.ValuesValuesA, Curve=line)  # -> Point, Parameter, Distance
curve_closest_point_4 = CurveClosestPoint(Point=sort_list_4.ValuesValuesA, Curve=line_2)  # -> Point, Parameter, Distance
polyline_3 = PolyLine(Vertices=curve_closest_point_4.Point, Closed=False)
polyline_4 = PolyLine(Vertices=curve_closest_point_3.Point, Closed=False)

# ---- group: out_
diagonal_two_axis_2 = Geometry(polyline)
grid_cell_outlines = Geometry(curve)
diagonal_one_axis_2 = Geometry(polyline_2)
