# Grasshopper definition Basic_Karamba_model_setup.gh (Grasshopper 1.0.7)
# plug-ins: Karamba3D

# ----
# Cross section and Material
number_slider = Slider(0.5, range=0..10)
material_selection_karamba3d = MaterialSelectionKaramba3D(menu=[dropdown(1), dropdown(4)])
cross_section_karamba3d = CrossSectionKaramba3D(
    FamilyNameOfCrossSection="DefaultCroSec",
    Material=material_selection_karamba3d,
    Diameter_cm=Slider(11.4, range=0..100),
    WallThickness_cm=number_slider,
    mode="Circular Hollow")

# ----
# Cross section and Material
number_slider_2 = Slider(57, range=0..100)
cross_section_range_selector_karamba3d = CrossSectionRangeSelectorKaramba3D(MaximumHeight_cm=-1, MaximumWidth_cm=-1, menu=[dropdown(3), dropdown(3), dropdown(2)])
panel = Panel(cross_section_range_selector_karamba3d)
list_item = ListItem(List=cross_section_range_selector_karamba3d, Index=number_slider_2, Wrap=True)

# ----
# Beam elements
beam_lines = Geometry()
explode = Explode(Curve=beam_lines, Recursive=True)  # -> Segments, Vertices
remove_duplicate_lines_karamba3d = RemoveDuplicateLinesKaramba3D(Line=explode.Segments, LimitDistance=0.005)  # -> OutLine, Info, Indexes
lng = ListLength(List=remove_duplicate_lines_karamba3d.OutLine)
series = Series(Start=0, Step=1, Count=lng)
concat = Concatenate(FragmentA="Add a prefix", FragmentB=series)
line_to_beam_karamba3d = LineToBeamKaramba3D(
    Line=remove_duplicate_lines_karamba3d.OutLine,
    Identifier=concat,
    CrossSection=cross_section_karamba3d,
    New=True,
    Remove=True,
    LimitDistance_m=0.005,
    Bending=True,
    SetBucklingLength=True,
    ToPolylineMaxAngle=0.03,
    ToPolylineTolerance=0.01,
    ToPolylineMinEdgeLength=0.25)  # -> Element, Points, Info

# ----
# Supports
cull_duplicates = CullDuplicates(Tolerance=0.1, CullMode=3)  # -> Points, Indices, Valence
support_karamba3d = SupportKaramba3D(PosInd=flatten(cull_duplicates.Points), menu=[buttons(on, on, on, off, off, off)])

# ---- group: Beam_elements
merge = Merge(Data1=line_to_beam_karamba3d.Element)  # -> flatten(Result)

# ---- group: Beam_ids
merge_2 = Merge(Data1=concat)  # -> flatten(Result)

# ----
# Loads
beam_ids = Data(merge_2)
negative = Negative(Value="0.6")
negative_2 = Negative(Value="2.7")
unit_z = UnitZ(Factor=negative)
negative_3 = Negative(Value="2")
unit_z_2 = UnitZ(Factor=negative_2)
unit_z_3 = UnitZ(Factor=negative_3)
beam_loads_karamba3d_ll = BeamLoadsKaramba3D(
    BeamIdentifier=beam_ids,
    LoadCase="Load combination",
    ForceVector=unit_z,
    TStart=0,
    TEnd=1,
    mode="Block",
    menu=[buttons(off, on, off)])
beam_loads_karamba3d_sdl = BeamLoadsKaramba3D(
    BeamIdentifier=beam_ids,
    LoadCase="Load combination",
    ForceVector=unit_z_2,
    TStart=0,
    TEnd=1,
    mode="Block",
    menu=[buttons(off, off, on)])
loads_karamba3d = LoadsKaramba3D(Vector=unit_z_3, LCase="Load combination", mode="Gravity")
merge_3 = Merge(Data1=flatten(beam_loads_karamba3d_ll), Data2=flatten(beam_loads_karamba3d_sdl), Data3=flatten(loads_karamba3d))  # -> flatten(Result)

# ---- group: Beam_nodes
merge_4 = Merge(Data1=line_to_beam_karamba3d.Points)  # -> flatten(Result)

# ----
# Assemble Model
assemble_model_karamba3d = AssembleModelKaramba3D(Elem=flatten(merge), Support=flatten(support_karamba3d), Load=merge_3, LimitDistance_m=0.005)  # -> Model, Info, Mass_kg, CenterOfGravity, LoadCaseNames
analyze_karamba3d = AnalyzeKaramba3D(Model=assemble_model_karamba3d.Model)  # -> CalculatedModel, MaximumDisplacement_cm, ResultingForceOfGravity_kN, ElasticEnergyChange_kNm

# ----
# Vizualise
model_view_karamba3d = ModelViewKaramba3D(Model=analyze_karamba3d.CalculatedModel, ResultFactors=1, ResultCase=-1)  # -> Model, DeformedMesh, DeformedAxes, DeformedModel
beam_view_karamba3d = BeamViewKaramba3D(Model=model_view_karamba3d.Model)  # -> Model, MeshesOfRenderedBeams, DeformedBeamAxes, LegendColors, LegendTags

model_view_karamba3d_2 = ModelViewKaramba3D(ResultFactors=1, ResultCase=-1)  # -> Model, DeformedMesh, DeformedAxes, DeformedModel
beam_view_karamba3d_2 = BeamViewKaramba3D(Model=model_view_karamba3d_2.Model)  # -> Model, MeshesOfRenderedBeams, DeformedBeamAxes, LegendColors, LegendTags
geometry = Geometry(beam_view_karamba3d_2.MeshesOfRenderedBeams)  # disabled
