# Grasshopper definition Deflection_and_strength_check.gh (Grasshopper 1.0.7)
# plug-ins: Karamba3D

# ---- group: Inputs
utilization_limit = Slider(1, range=0..1)
load_case = Slider(12, range=0..18)
element_identifiers = Data()
# Strength/Utilization Check
analysed_model = Data()

# Span/Deflection Check
support_locations = Data()
span_deflection_limit = Slider(180, range=0..1000)
load_case_2 = Slider(12, range=0..18)
analysed_model_2 = Data()

# ----
disassemble_model_karamba3d = DisassembleModelKaramba3D(Model=analysed_model_2)  # -> Model, Point, Beam, Shell, Support, Load, Line, Mesh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
disassemble_model_karamba3d_2 = DisassembleModelKaramba3D(Model=analysed_model_2)  # -> Model, Point, Beam, Shell, Support, Load, Line, Mesh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
nodal_displacements_karamba3d = NodalDisplacementsKaramba3D(PositionsIndexes=disassemble_model_karamba3d.Point, LoadCase=load_case_2)  # -> AnalyzedModel, NodalTranslations_m, NodalRotations_rad
all_node_points = Data(disassemble_model_karamba3d_2.Point)
all_node_points_graft = Point(graft(all_node_points))
all_node_points_flatten = Data(flatten(all_node_points))
deconstruct = Deconstruct(Point=nodal_displacements_karamba3d.NodalTranslations_m)  # -> XComponent, YComponent, ZComponent
distance = Distance(PointA=all_node_points_graft, PointB=support_locations)
flatten_tree = FlattenTree(Tree=all_node_points_flatten, Path="{0}")
sort_list = SortList(Keys=distance, ValuesValuesA=distance)  # -> Keys, ValuesValuesA
deflections = Data(deconstruct.ZComponent)
absolute = Absolute(Value=deflections)
list_item = ListItem(List=sort_list.ValuesValuesA, Index=0, Wrap=True)
division = Division(A=simplify(graft(list_item)), B=simplify(graft(absolute)))  # -> flatten(Result)
list_length = ListLength(List=division)
series = Series(Start=0, Step=1, Count=list_length)
null_item = NullItem(Item=division)  # -> NullFlags, InvalidFlags, Description
addition = Addition(A=span_deflection_limit, B="1")
cull_pattern = CullPattern(List=series, CullPattern=null_item.NullFlags)
replace_items = ReplaceItems(List=division, Item=addition, Indices=cull_pattern, Wrap=False)
round = Round(Number=replace_items)  # -> Nearest, Floor, Ceiling
larger_than = LargerThan(FirstNumber=round.Floor, SecondNumber=span_deflection_limit)  # -> LargerThan, OrEqualTo
cull_pattern_2 = CullPattern(List=round.Floor, CullPattern=invert(larger_than.OrEqualTo))
bnd = Bounds(Numbers=cull_pattern_2)
dedomain = DeconstructDomain(Domain=bnd)  # -> Start, End
gradient = Gradient(
    LowerLimit=dedomain.End,
    UpperLimit=dedomain.Start,
    Parameter=cull_pattern_2,
    stops=[0: RGB(0, 128, 0), 0.483: RGB(255, 255, 0), 1: RGB(255, 0, 0)])
cull_pattern_3 = CullPattern(List=flatten_tree, CullPattern=invert(larger_than.OrEqualTo))
preview = CustomPreview(Geometry=cull_pattern_3, Material=gradient)

utilization_of_elements_karamba3d = UtilizationOfElementsKaramba3D(
    AnalyzedModel=analysed_model,
    ElementsIdentifiers=element_identifiers,
    LoadCase=load_case,
    NumberOfSamplePoints=3,
    ElasticDesign=True,
    GammaM0=1,
    GammaM1=1.1,
    SwayFrame=True,
    WithDetails=False,
    mode="Beams")  # -> AnalyzedModel, Utilization, SigMax_kN_cm2, SigMin_kN_cm2, TauMax_kN_cm2, UtilN, UtilVy, UtilVz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
element_query_karamba3d = ElementQueryKaramba3D(Model=analysed_model, ElementsIdentifiers=element_identifiers)  # -> Model, Mass_kg, Area_m2, Volume_m3, Meshes
larger_than_2 = LargerThan(FirstNumber=utilization_of_elements_karamba3d.Utilization, SecondNumber=utilization_limit)  # -> LargerThan, OrEqualTo
sort_list_2 = SortList(Keys=utilization_of_elements_karamba3d.Utilization, ValuesValuesA=utilization_of_elements_karamba3d.Utilization)  # -> Keys, ValuesValuesA
list_item_2 = ListItem(List=sort_list_2.ValuesValuesA, Index=0, Wrap=True)  # -> Item1, Item
cull_pattern_4 = CullPattern(List=element_query_karamba3d.Meshes, CullPattern=invert(larger_than_2.LargerThan))
cull_pattern_5 = CullPattern(List=element_query_karamba3d.Meshes, CullPattern=larger_than_2.LargerThan)
gradient_2 = Gradient(
    LowerLimit=list_item_2.Item,
    UpperLimit=list_item_2.Item1,
    Parameter=utilization_of_elements_karamba3d.Utilization,
    stops=[0: RGB(0, 128, 0), 0.5: RGB(255, 255, 0), 1: RGB(255, 0, 0)])
geometry = Geometry(cull_pattern_5)
geometry_2 = Geometry(cull_pattern_4)
mesh_colours = MeshColours(Mesh=geometry, Colours=ColourSwatch(SwatchColor=RGB(240, 0, 0)))
mesh_colours_2 = MeshColours(Mesh=geometry_2, Colours=ColourSwatch(SwatchColor=RGB(155, 242, 48)))
mesh_colours_3 = MeshColours(Mesh=graft(element_query_karamba3d.Meshes), Colours=graft(gradient_2))  # disabled
custom_preview = CustomPreview(Geometry=element_query_karamba3d.Meshes, Material=gradient_2)  # disabled

# ---- group: View_actual_Numbers
text_tag_3d = TextTag3D(Location=all_node_points_flatten, Text=round.Floor, Size=Slider(0.2, range=0..1), Justification=7)
text_tag = TextTag(Location=all_node_points_flatten, Text=round.Floor)
