# Grasshopper definition Karamba_Load_Cases.gh (Grasshopper 1.0.7)
# plug-ins: Karamba3D

# BEAM LOADS AND COMBINATIONS
element_identifiers = Data()

# ---- group: in_
kn = Panel("2.7")

# ----
factor = Panel("0.9")
kn_2 = Panel(kn)
multiplication = Multiplication(A=kn_2, B=factor)
Z = UnitZ(Factor=multiplication)
load_combination = Panel("UW5")
neg = Negative(Value=Z)

factor_2 = Panel("1.2")
kn_3 = Panel(kn)
multiplication_2 = Multiplication(A=kn_3, B=factor_2)
Z_2 = UnitZ(Factor=multiplication_2)
load_combination_2 = Panel("UW1")
neg_2 = Negative(Value=Z_2)

kn_4 = Panel(kn)
factor_3 = Panel("1")
multiplication_3 = Multiplication(A=kn_4, B=factor_3)
Z_3 = UnitZ(Factor=multiplication_3)
load_combination_3 = Panel("SG2")
neg_3 = Negative(Value=Z_3)

kn_5 = Panel(kn)
factor_4 = Panel("1")
multiplication_4 = Multiplication(A=kn_5, B=factor_4)
Z_4 = UnitZ(Factor=multiplication_4)
load_combination_4 = Panel("DStlD1")
neg_4 = Negative(Value=Z_4)

Z_5 = UnitZ(Factor=kn)
neg_5 = Negative(Value=Z_5)

top_element_identifiers = Data(element_identifiers)
top_element_identifiers_2 = Data(element_identifiers)
# Load_Combinations
top_element_identifiers_3 = Data(element_identifiers)
top_element_identifiers_4 = Data(element_identifiers)

# ---- group: karamba_
panel = Panel("1")
panel_2 = Panel("0")

panel_3 = Panel("0")
panel_4 = Panel("1")

panel_5 = Panel("0")
panel_6 = Panel("1")

panel_7 = Panel("1")
panel_8 = Panel("0")

panel_9 = Panel("0")
panel_10 = Panel("1")

panel_11 = Panel("1")
panel_12 = Panel("0")

panel_13 = Panel("0")
panel_14 = Panel("1")

panel_15 = Panel("0")
panel_16 = Panel("1")

panel_17 = Panel("0")
panel_18 = Panel("1")

beam_loads = BeamLoadsKaramba3D(
    BeamIdentifier=element_identifiers,
    LoadCase="SDL",
    ForceVector=neg_5,
    TStart=panel_2,
    TEnd=panel,
    mode="Block",
    menu=[buttons(off, on, off)])  # -> flatten(Load)

beam_loads_2 = BeamLoadsKaramba3D(
    BeamIdentifier=top_element_identifiers,
    LoadCase=load_combination,
    ForceVector=neg,
    TStart=panel_5,
    TEnd=panel_6,
    mode="Block",
    menu=[buttons(off, on, off)])  # -> flatten(Load)

beam_loads_3 = BeamLoadsKaramba3D(
    BeamIdentifier=top_element_identifiers_2,
    LoadCase=load_combination_2,
    ForceVector=neg_2,
    TStart=panel_12,
    TEnd=panel_11,
    mode="Block",
    menu=[buttons(off, on, off)])  # -> flatten(Load)

beam_loads_4 = BeamLoadsKaramba3D(
    BeamIdentifier=top_element_identifiers_3,
    LoadCase=load_combination_4,
    ForceVector=neg_4,
    TStart=panel_13,
    TEnd=panel_14,
    mode="Block",
    menu=[buttons(off, on, off)])  # -> flatten(Load)

beam_loads_5 = BeamLoadsKaramba3D(
    BeamIdentifier=top_element_identifiers_4,
    LoadCase=load_combination_3,
    ForceVector=neg_3,
    TStart=panel_17,
    TEnd=panel_18,
    mode="Block",
    menu=[buttons(off, on, off)])  # -> flatten(Load)

# ---- group: in_
kn_6 = Panel("0.6")

# ----
kn_7 = Panel(kn_6)
factor_5 = Panel("1.6")
multiplication_5 = Multiplication(A=kn_7, B=factor_5)
Z_6 = UnitZ(Factor=multiplication_5)
neg_6 = Negative(Value=Z_6)

kn_8 = Panel(kn_6)
factor_6 = Panel("1")
multiplication_6 = Multiplication(A=kn_8, B=factor_6)
Z_7 = UnitZ(Factor=multiplication_6)
neg_7 = Negative(Value=Z_7)

# ---- group: karamba_
beam_loads_6 = BeamLoadsKaramba3D(
    BeamIdentifier=top_element_identifiers_2,
    LoadCase=load_combination_2,
    ForceVector=neg_6,
    TStart=panel_8,
    TEnd=panel_7,
    mode="Block",
    menu=[buttons(off, off, on)])  # -> flatten(Load)

beam_loads_7 = BeamLoadsKaramba3D(
    BeamIdentifier=top_element_identifiers_4,
    LoadCase=load_combination_3,
    ForceVector=neg_7,
    TStart=panel_15,
    TEnd=panel_16,
    mode="Block",
    menu=[buttons(off, off, on)])  # -> flatten(Load)

# ----
merge = Merge(Data1=beam_loads_4)
merge_2 = Merge(Data1=beam_loads_5, Data2=beam_loads_7)  # -> flatten(Result)

Z_8 = UnitZ(Factor=kn_6)
neg_8 = Negative(Value=Z_8)

# ---- group: karamba_
panel_19 = Panel("1")
panel_20 = Panel("0")

# ----
kn_9 = Panel(kn)
factor_7 = Panel("1")
multiplication_7 = Multiplication(A=kn_9, B=factor_7)
Z_9 = UnitZ(Factor=multiplication_7)
load_combination_5 = Panel("UW6")
neg_9 = Negative(Value=Z_9)

# ---- group: karamba_
# Load_Cases
beam_loads_8 = BeamLoadsKaramba3D(
    BeamIdentifier=element_identifiers,
    LoadCase="LL",
    ForceVector=neg_8,
    TStart=panel_20,
    TEnd=panel_19,
    mode="Block",
    menu=[buttons(off, off, on)])  # -> flatten(Load)

# ----
kn_10 = Panel(kn)
factor_8 = Panel("1.2")
multiplication_8 = Multiplication(A=kn_10, B=factor_8)
Z_10 = UnitZ(Factor=multiplication_8)
load_combination_6 = Panel("UW2")
neg_10 = Negative(Value=Z_10)

kn_11 = Panel(kn_6)
factor_9 = Panel("1.6")
multiplication_9 = Multiplication(A=kn_11, B=factor_9)
Z_11 = UnitZ(Factor=multiplication_9)
neg_11 = Negative(Value=Z_11)

kn_12 = Panel(kn)
factor_10 = Panel("1")
multiplication_10 = Multiplication(A=kn_12, B=factor_10)
Z_12 = UnitZ(Factor=multiplication_10)
load_combination_7 = Panel("SW1")
neg_12 = Negative(Value=Z_12)

kn_13 = Panel(kn)
factor_11 = Panel("0.6")
multiplication_11 = Multiplication(A=kn_13, B=factor_11)
Z_13 = UnitZ(Factor=multiplication_11)
load_combination_8 = Panel("SW3")
neg_13 = Negative(Value=Z_13)

top_element_identifiers_5 = Data(element_identifiers)
top_element_identifiers_6 = Data(element_identifiers)

# ---- group: in_
kn_14 = Panel("2.1")

# ----
factor_12 = Panel("0.5")
kn_15 = Panel(kn_14)
multiplication_12 = Multiplication(A=kn_15, B=factor_12)
Z_14 = UnitZ(Factor=multiplication_12)

kn_16 = Panel(kn_14)
factor_13 = Panel("1")
multiplication_13 = Multiplication(A=kn_16, B=factor_13)
Z_15 = UnitZ(Factor=multiplication_13)

# ---- group: karamba_
beam_loads_9 = BeamLoadsKaramba3D(
    BeamIdentifier=top_element_identifiers_2,
    LoadCase=load_combination_2,
    ForceVector=Z_14,
    TStart=panel_3,
    TEnd=panel_4,
    mode="Block",
    menu=[buttons(on, off, off)])  # -> flatten(Load)

beam_loads_10 = BeamLoadsKaramba3D(
    BeamIdentifier=top_element_identifiers,
    LoadCase=load_combination,
    ForceVector=Z_15,
    TStart=panel_9,
    TEnd=panel_10,
    mode="Block",
    menu=[buttons(on, off, off)])  # -> flatten(Load)

# ----
merge_3 = Merge(Data1=beam_loads_2, Data2=beam_loads_10)
merge_4 = Merge(Data1=beam_loads_3, Data2=beam_loads_6, Data3=beam_loads_9)  # -> flatten(Result)

kn_17 = Panel(kn_14)
factor_14 = Panel("1")
multiplication_14 = Multiplication(A=kn_17, B=factor_14)
Z_16 = UnitZ(Factor=multiplication_14)

kn_18 = Panel(kn_14)
factor_15 = Panel("1")
multiplication_15 = Multiplication(A=kn_18, B=factor_15)
Z_17 = UnitZ(Factor=multiplication_15)

top_element_identifiers_7 = Data(element_identifiers)
top_element_identifiers_8 = Data(element_identifiers)

Z_18 = UnitZ(Factor=kn_14)

# ---- group: karamba_
panel_21 = Panel("1")
panel_22 = Panel("0")

panel_23 = Panel("0")
panel_24 = Panel("1")

panel_25 = Panel("0")
panel_26 = Panel("1")

panel_27 = Panel("1")
panel_28 = Panel("0")

panel_29 = Panel("1")
panel_30 = Panel("0")

panel_31 = Panel("0")
panel_32 = Panel("1")

panel_33 = Panel("0")
panel_34 = Panel("1")

panel_35 = Panel("0")
panel_36 = Panel("1")

beam_loads_11 = BeamLoadsKaramba3D(
    BeamIdentifier=top_element_identifiers_5,
    LoadCase=load_combination_5,
    ForceVector=neg_9,
    TStart=panel_23,
    TEnd=panel_24,
    mode="Block",
    menu=[buttons(off, on, off)])  # -> flatten(Load)

beam_loads_12 = BeamLoadsKaramba3D(
    BeamIdentifier=top_element_identifiers_6,
    LoadCase=load_combination_6,
    ForceVector=neg_11,
    TStart=panel_28,
    TEnd=panel_27,
    mode="Block",
    menu=[buttons(off, off, on)])  # -> flatten(Load)

beam_loads_13 = BeamLoadsKaramba3D(
    BeamIdentifier=top_element_identifiers_6,
    LoadCase=load_combination_6,
    ForceVector=neg_10,
    TStart=panel_30,
    TEnd=panel_29,
    mode="Block",
    menu=[buttons(off, on, off)])  # -> flatten(Load)

panel_37 = Panel("1")
panel_38 = Panel("0")

panel_39 = Panel("0")
panel_40 = Panel("1")

beam_loads_14 = BeamLoadsKaramba3D(
    BeamIdentifier=element_identifiers,
    LoadCase="WUL",
    ForceVector=Z_18,
    TStart=panel_33,
    TEnd=panel_34,
    mode="Block",
    menu=[buttons(on, off, off)])  # -> flatten(Load)

beam_loads_15 = BeamLoadsKaramba3D(
    BeamIdentifier=top_element_identifiers_7,
    LoadCase=load_combination_7,
    ForceVector=neg_12,
    TStart=panel_31,
    TEnd=panel_32,
    mode="Block",
    menu=[buttons(off, on, off)])  # -> flatten(Load)

beam_loads_16 = BeamLoadsKaramba3D(
    LoadCase=load_combination_7,
    ForceVector=Z_16,
    TStart=panel_35,
    TEnd=panel_36,
    mode="Block",
    menu=[buttons(on, off, off)])  # -> flatten(Load)

beam_loads_17 = BeamLoadsKaramba3D(
    BeamIdentifier=top_element_identifiers_8,
    LoadCase=load_combination_8,
    ForceVector=neg_13,
    TStart=panel_38,
    TEnd=panel_37,
    mode="Block",
    menu=[buttons(off, on, off)])  # -> flatten(Load)

beam_loads_18 = BeamLoadsKaramba3D(
    BeamIdentifier=top_element_identifiers_8,
    LoadCase=load_combination_8,
    ForceVector=Z_17,
    TStart=panel_39,
    TEnd=panel_40,
    mode="Block",
    menu=[buttons(on, off, off)])  # -> flatten(Load)

# ---- group: in_
kn_19 = Panel("2.0")

# ----
kn_20 = Panel(kn_19)
factor_16 = Panel("1")
multiplication_16 = Multiplication(A=kn_20, B=factor_16)
Z_19 = UnitZ(Factor=multiplication_16)
neg_14 = Negative(Value=Z_19)

kn_21 = Panel(kn_19)
factor_17 = Panel("0.5")
multiplication_17 = Multiplication(A=kn_21, B=factor_17)
Z_20 = UnitZ(Factor=multiplication_17)
neg_15 = Negative(Value=Z_20)

# ---- group: karamba_
beam_loads_19 = BeamLoadsKaramba3D(
    BeamIdentifier=top_element_identifiers_6,
    LoadCase=load_combination_6,
    ForceVector=neg_15,
    TStart=panel_25,
    TEnd=panel_26,
    mode="Block",
    menu=[buttons(on, off, off)])  # -> flatten(Load)

beam_loads_20 = BeamLoadsKaramba3D(
    BeamIdentifier=top_element_identifiers_5,
    LoadCase=load_combination_5,
    ForceVector=neg_14,
    TStart=panel_22,
    TEnd=panel_21,
    mode="Block",
    menu=[buttons(on, off, off)])  # -> flatten(Load)

# ----
merge_5 = Merge(Data1=beam_loads_11, Data2=beam_loads_20)
merge_6 = Merge(Data1=beam_loads_13, Data2=beam_loads_12, Data3=beam_loads_19)  # -> flatten(Result)
merge_7 = Merge(Data1=beam_loads_15, Data2=beam_loads_16)
merge_8 = Merge(Data1=beam_loads_17, Data2=beam_loads_18)

Z_21 = UnitZ(Factor=kn_19)
neg_16 = Negative(Value=Z_21)

kn_22 = Panel(kn)
factor_18 = Panel("1.2")
multiplication_18 = Multiplication(A=kn_22, B=factor_18)
Z_22 = UnitZ(Factor=multiplication_18)
load_combination_9 = Panel("UW3")
neg_17 = Negative(Value=Z_22)

# ---- group: karamba_
panel_41 = Panel("0")
panel_42 = Panel("1")

# ----
kn_23 = Panel(kn_6)
factor_19 = Panel("1")
multiplication_19 = Multiplication(A=kn_23, B=factor_19)
Z_23 = UnitZ(Factor=multiplication_19)
neg_18 = Negative(Value=Z_23)

kn_24 = Panel(kn)
factor_20 = Panel("1")
multiplication_20 = Multiplication(A=kn_24, B=factor_20)
Z_24 = UnitZ(Factor=multiplication_20)
load_combination_10 = Panel("SW2")
neg_19 = Negative(Value=Z_24)

factor_21 = Panel("1")
kn_25 = Panel(kn_14)
multiplication_21 = Multiplication(A=kn_25, B=factor_21)
Z_25 = UnitZ(Factor=multiplication_21)

kn_26 = Panel(kn)
factor_22 = Panel("0.6")
multiplication_22 = Multiplication(A=kn_26, B=factor_22)
Z_26 = UnitZ(Factor=multiplication_22)
load_combination_11 = Panel("SW4")
neg_20 = Negative(Value=Z_26)

# ---- group: karamba_
beam_loads_21 = BeamLoadsKaramba3D(
    BeamIdentifier=element_identifiers,
    LoadCase="WDL",
    ForceVector=neg_16,
    TStart=panel_41,
    TEnd=panel_42,
    mode="Block",
    menu=[buttons(on, off, off)])  # -> flatten(Load)

# ----
kn_27 = Panel(kn_19)
factor_23 = Panel("1")
multiplication_23 = Multiplication(A=kn_27, B=factor_23)
Z_27 = UnitZ(Factor=multiplication_23)
neg_21 = Negative(Value=Z_27)

top_element_identifiers_9 = Data(element_identifiers)

kn_28 = Panel(kn_19)
factor_24 = Panel("1")
multiplication_24 = Multiplication(A=kn_28, B=factor_24)
Z_28 = UnitZ(Factor=multiplication_24)
neg_22 = Negative(Value=Z_28)

top_element_identifiers_10 = Data(element_identifiers)
top_element_identifiers_11 = Data(element_identifiers)

# ---- group: karamba_
panel_43 = Panel("0")
panel_44 = Panel("1")

panel_45 = Panel("0")
panel_46 = Panel("1")

panel_47 = Panel("1")
panel_48 = Panel("0")

beam_loads_22 = BeamLoadsKaramba3D(
    BeamIdentifier=top_element_identifiers_9,
    LoadCase=load_combination_9,
    ForceVector=Z_25,
    TStart=panel_43,
    TEnd=panel_44,
    mode="Block",
    menu=[buttons(on, off, off)])  # -> flatten(Load)

panel_49 = Panel("0")
panel_50 = Panel("1")

panel_51 = Panel("0")
panel_52 = Panel("1")

beam_loads_23 = BeamLoadsKaramba3D(
    BeamIdentifier=top_element_identifiers_9,
    LoadCase=load_combination_9,
    ForceVector=neg_18,
    TStart=panel_45,
    TEnd=panel_46,
    mode="Block",
    menu=[buttons(off, off, on)])  # -> flatten(Load)

beam_loads_24 = BeamLoadsKaramba3D(
    BeamIdentifier=top_element_identifiers_9,
    LoadCase=load_combination_9,
    ForceVector=neg_17,
    TStart=panel_48,
    TEnd=panel_47,
    mode="Block",
    menu=[buttons(off, on, off)])  # -> flatten(Load)

panel_53 = Panel("0")
panel_54 = Panel("1")

panel_55 = Panel("0")
panel_56 = Panel("1")

beam_loads_25 = BeamLoadsKaramba3D(
    BeamIdentifier=top_element_identifiers_10,
    LoadCase=load_combination_10,
    ForceVector=neg_19,
    TStart=panel_49,
    TEnd=panel_50,
    mode="Block",
    menu=[buttons(off, on, off)])  # -> flatten(Load)

beam_loads_26 = BeamLoadsKaramba3D(
    BeamIdentifier=top_element_identifiers_10,
    LoadCase=load_combination_10,
    ForceVector=neg_21,
    TStart=panel_51,
    TEnd=panel_52,
    mode="Block",
    menu=[buttons(on, off, off)])  # -> flatten(Load)

beam_loads_27 = BeamLoadsKaramba3D(
    BeamIdentifier=top_element_identifiers_11,
    LoadCase=load_combination_11,
    ForceVector=neg_20,
    TStart=panel_55,
    TEnd=panel_56,
    mode="Block",
    menu=[buttons(off, on, off)])  # -> flatten(Load)

beam_loads_28 = BeamLoadsKaramba3D(
    BeamIdentifier=top_element_identifiers_11,
    LoadCase=load_combination_11,
    ForceVector=neg_22,
    TStart=panel_53,
    TEnd=panel_54,
    mode="Block",
    menu=[buttons(on, off, off)])  # -> flatten(Load)

# ----
neg_23 = Negative(Value="1")
merge_9 = Merge(Data1=beam_loads_24, Data2=beam_loads_23, Data3=beam_loads_22)  # -> flatten(Result)
merge_10 = Merge(Data1=beam_loads_25, Data2=beam_loads_26)
panel_57 = Panel("""DStlD1
SG2
SW1
SW2
SW3
SW4
UD
UDL
UW1
UW2
UW3
UW4
UW5
UW6""")
Z_29 = UnitZ(Factor=neg_23)
merge_11 = Merge(Data1=beam_loads_27, Data2=beam_loads_28)

kn_29 = Panel(kn)
factor_25 = Panel("1.2")
multiplication_25 = Multiplication(A=kn_29, B=factor_25)
Z_30 = UnitZ(Factor=multiplication_25)
load_combination_12 = Panel("UW4")
neg_24 = Negative(Value=Z_30)

kn_30 = Panel(kn_6)
factor_26 = Panel("1")
multiplication_26 = Multiplication(A=kn_30, B=factor_26)
Z_31 = UnitZ(Factor=multiplication_26)
neg_25 = Negative(Value=Z_31)

loads = LoadsKaramba3D(Vector=Z_29, LCase=panel_57, mode="Gravity")

kn_31 = Panel(kn_19)
factor_27 = Panel("1")
multiplication_27 = Multiplication(A=kn_31, B=factor_27)
Z_32 = UnitZ(Factor=multiplication_27)
neg_26 = Negative(Value=Z_32)

kn_32 = Panel(kn)
factor_28 = Panel("1.2")
multiplication_28 = Multiplication(A=kn_32, B=factor_28)
Z_33 = UnitZ(Factor=multiplication_28)
load_combination_13 = Panel("UDL")
neg_27 = Negative(Value=Z_33)

factor_29 = Panel("1.4")
kn_33 = Panel(kn)
multiplication_29 = Multiplication(A=kn_33, B=factor_29)
Z_34 = UnitZ(Factor=multiplication_29)
load_combination_14 = Panel("UD")
neg_28 = Negative(Value=Z_34)

kn_34 = Panel(kn_6)
factor_30 = Panel("1.6")
multiplication_30 = Multiplication(A=kn_34, B=factor_30)
Z_35 = UnitZ(Factor=multiplication_30)
neg_29 = Negative(Value=Z_35)

top_element_identifiers_12 = Data(element_identifiers)

# ---- group: karamba_
panel_58 = Panel("1")
panel_59 = Panel("0")

panel_60 = Panel("1")
panel_61 = Panel("0")

# ----
top_element_identifiers_13 = Data(element_identifiers)
top_element_identifiers_14 = Data(element_identifiers)

# ---- group: karamba_
panel_62 = Panel("1")
panel_63 = Panel("0")

beam_loads_29 = BeamLoadsKaramba3D(
    BeamIdentifier=top_element_identifiers_12,
    LoadCase=load_combination_12,
    ForceVector=neg_26,
    TStart=panel_59,
    TEnd=panel_58,
    mode="Block",
    menu=[buttons(on, off, off)])  # -> flatten(Load)

beam_loads_30 = BeamLoadsKaramba3D(
    BeamIdentifier=top_element_identifiers_12,
    LoadCase=load_combination_12,
    ForceVector=neg_25,
    TStart=panel_61,
    TEnd=panel_60,
    mode="Block",
    menu=[buttons(off, off, on)])  # -> flatten(Load)

beam_loads_31 = BeamLoadsKaramba3D(
    BeamIdentifier=top_element_identifiers_12,
    LoadCase=load_combination_12,
    ForceVector=neg_24,
    TStart=panel_63,
    TEnd=panel_62,
    mode="Block",
    menu=[buttons(off, on, off)])  # -> flatten(Load)

panel_64 = Panel("0")
panel_65 = Panel("1")

panel_66 = Panel("0")
panel_67 = Panel("1")

panel_68 = Panel("0")
panel_69 = Panel("1")

beam_loads_32 = BeamLoadsKaramba3D(
    BeamIdentifier=top_element_identifiers_13,
    LoadCase=load_combination_13,
    ForceVector=neg_29,
    TStart=panel_64,
    TEnd=panel_65,
    mode="Block",
    menu=[buttons(off, off, on)])  # -> flatten(Load)

beam_loads_33 = BeamLoadsKaramba3D(
    BeamIdentifier=top_element_identifiers_13,
    LoadCase=load_combination_13,
    ForceVector=neg_27,
    TStart=panel_66,
    TEnd=panel_67,
    mode="Block",
    menu=[buttons(on, off, off)])  # -> flatten(Load)

beam_loads_34 = BeamLoadsKaramba3D(
    BeamIdentifier=top_element_identifiers_14,
    LoadCase=load_combination_14,
    ForceVector=neg_28,
    TStart=panel_68,
    TEnd=panel_69,
    mode="Block",
    menu=[buttons(off, on, off)])  # -> flatten(Load)

# ----
merge_12 = Merge(Data1=beam_loads_31, Data2=beam_loads_30, Data3=beam_loads_29)  # -> flatten(Result)
merge_13 = Merge(Data1=beam_loads_33, Data2=beam_loads_32)  # -> flatten(Result)
merge_14 = Merge(Data1=beam_loads_34)

wul = Data(beam_loads_14)
dstld2 = Data(merge_2)
wdl = Data(beam_loads_21)
dstld1 = Data(merge)
sw1 = Data(merge_7)
sw4 = Data(merge_11)
ud = Data(merge_14)
uw1 = Data(merge_4)
uw2 = Data(merge_6)
# Load_Combinations
sdl = Data(beam_loads)
ll = Data(beam_loads_8)
sw2 = Data(merge_10)
sw3 = Data(merge_8)
udl = Data(merge_13)
uw3 = Data(merge_9)
uw4 = Data(merge_12)
uw5 = Data(merge_3)
uw6 = Data(merge_5)
sw = Data(loads)
merge_15 = Merge(
    Data1=sdl,
    Data2=ll,
    Data3=wul,
    Data4=wdl,
    Data5=dstld1,
    Data6=dstld2,
    Data7=sw1,
    Data8=sw2,
    Data9=sw3,
    Data10=sw4,
    Data11=ud,
    Data12=udl,
    Data13=uw1,
    Data14=uw2,
    Data15=uw3,
    Data16=uw4,
    Data17=uw5,
    Data18=uw6,
    Data19=sw)  # -> flatten(Result)

# ----
# MESH LOADS AND COMBINATIONS
element_identifiers_2 = Data()
ref_mesh = Data()

# ----
# SDL
kn_sdl_kn_m2 = Panel("3.5")
# Load_Cases
unit_z = UnitZ(Factor=kn_sdl_kn_m2)
top_element_identifiers_15 = Data(element_identifiers_2)
negative = Negative(Value=unit_z)
refined_mesh = Geometry(ref_mesh)
loads_karamba3d_sdl = LoadsKaramba3D(
    Vector=negative,
    Mesh=refined_mesh,
    ElementIdentifiers=top_element_identifiers_15,
    LCase="SDL",
    mode="MeshLoad -Const.",
    menu=[buttons(off, on, off), buttons(on, on)])

factor_31 = Panel("1")
# Load_Combinations
# DStlD1 = 1DL
# DStlD2 = 1DL +1LL
# SW1 = 1DL + 1WUL
# SW2 = 1DL + 1WDL
# SW3 = 0.6DL + 1WUL
# SW4= 0.6DL + 1WDL
# UD = 1.4 DL
# UDL = 1.2DL +1.6LL
# UW1= 1.2DL  1.6LL + 0.5WUL
# UW2= 1.2DL + 1.6LL +0.5WDL
# UW3 = 1.2DL + 1LL + 1WUL
# UW4 = 1.2DL + 1LL + 1WDL
# UW5 = 0.9DL + 1WUL
# UW6 = 0.9DL + 1WDL
multiplication_31 = Multiplication(A=kn_sdl_kn_m2, B=factor_31)
# DStlD1
Z_36 = UnitZ(Factor=multiplication_31)
load_combination_15 = Panel("DStlD1")
refined_mesh_2 = Geometry(ref_mesh)
neg_30 = Negative(Value=Z_36)
loads_karamba3d_sdl_2 = LoadsKaramba3D(
    Vector=neg_30,
    Mesh=refined_mesh_2,
    ElementIdentifiers=top_element_identifiers_15,
    LCase=load_combination_15,
    mode="MeshLoad -Const.",
    menu=[buttons(off, on, off), buttons(on, on)])

top_element_identifiers_16 = Data(element_identifiers_2)
top_element_identifiers_17 = Data(element_identifiers_2)

factor_32 = Panel("0.9")
panel_70 = Panel(kn_sdl_kn_m2)  # "KN/m2"
multiplication_32 = Multiplication(A=panel_70, B=factor_32)
Z_37 = UnitZ(Factor=multiplication_32)
load_combination_16 = Panel("UW5")
refined_mesh_3 = Geometry(ref_mesh)
neg_31 = Negative(Value=Z_37)
loads_karamba3d_sdl_3 = LoadsKaramba3D(
    Vector=neg_31,
    Mesh=refined_mesh_3,
    ElementIdentifiers=top_element_identifiers_17,
    LCase=load_combination_16,
    mode="MeshLoad -Const.",
    menu=[buttons(off, on, off), buttons(on, on)])

refined_mesh_4 = Geometry(ref_mesh)

factor_33 = Panel("1.2")
kn_35 = Panel(kn_sdl_kn_m2)
multiplication_33 = Multiplication(A=kn_35, B=factor_33)
Z_38 = UnitZ(Factor=multiplication_33)
load_combination_17 = Panel("UW1")
neg_32 = Negative(Value=Z_38)
loads_karamba3d_sdl_4 = LoadsKaramba3D(
    Vector=neg_32,
    Mesh=refined_mesh_4,
    ElementIdentifiers=top_element_identifiers_16,
    LCase=load_combination_17,
    mode="MeshLoad -Const.",
    menu=[buttons(off, on, off), buttons(on, on)])

# ----
# DStlD2
top_element_identifiers_18 = Data(element_identifiers_2)
refined_mesh_5 = Geometry(ref_mesh)

panel_71 = Panel(kn_sdl_kn_m2)  # "KN/m2"
factor_34 = Panel("1")
multiplication_34 = Multiplication(A=panel_71, B=factor_34)
Z_39 = UnitZ(Factor=multiplication_34)
neg_33 = Negative(Value=Z_39)
load_combination_18 = Panel("DStlD2")
loads_karamba3d_sdl_5 = LoadsKaramba3D(
    Vector=neg_33,
    Mesh=refined_mesh_5,
    ElementIdentifiers=top_element_identifiers_18,
    LCase=load_combination_18,
    mode="MeshLoad -Const.",
    menu=[buttons(off, on, off), buttons(on, on)])

# ----
# LL
kn_ll_kn_m2 = Panel("0.8")
unit_z_2 = UnitZ(Factor=kn_ll_kn_m2)
top_element_identifiers_19 = Data(element_identifiers_2)
negative_2 = Negative(Value=unit_z_2)
refined_mesh_6 = Geometry(ref_mesh)
loads_karamba3d_ll = LoadsKaramba3D(
    Vector=negative_2,
    Mesh=refined_mesh_6,
    ElementIdentifiers=top_element_identifiers_19,
    LCase="LL",
    mode="MeshLoad -Const.",
    menu=[buttons(off, off, on), buttons(on, on)])

panel_72 = Panel(kn_ll_kn_m2)  # "KN/m2"
factor_35 = Panel("1.6")
multiplication_35 = Multiplication(A=panel_72, B=factor_35)
Z_40 = UnitZ(Factor=multiplication_35)
neg_34 = Negative(Value=Z_40)
loads_karamba3d_ll_2 = LoadsKaramba3D(
    Vector=neg_34,
    Mesh=refined_mesh_4,
    ElementIdentifiers=top_element_identifiers_16,
    LCase=load_combination_17,
    mode="MeshLoad -Const.",
    menu=[buttons(off, off, on), buttons(on, on)])

factor_36 = Panel("1")
panel_73 = Panel(kn_ll_kn_m2)  # "KN/m2"
multiplication_36 = Multiplication(A=panel_73, B=factor_36)
Z_41 = UnitZ(Factor=multiplication_36)
neg_35 = Negative(Value=Z_41)
loads_karamba3d_ll_3 = LoadsKaramba3D(
    Vector=neg_35,
    Mesh=refined_mesh_5,
    ElementIdentifiers=top_element_identifiers_18,
    LCase=load_combination_18,
    mode="MeshLoad -Const.",
    menu=[buttons(off, off, on), buttons(on, on)])

merge_16 = Merge(Data1=loads_karamba3d_sdl_2)
merge_17 = Merge(Data1=loads_karamba3d_sdl_5, Data2=loads_karamba3d_ll_3)  # -> flatten(Result)
top_element_identifiers_20 = Data(element_identifiers_2)

kn_36 = Panel(kn_sdl_kn_m2)
factor_37 = Panel("1.2")
multiplication_37 = Multiplication(A=kn_36, B=factor_37)
refined_mesh_7 = Geometry(ref_mesh)
Z_42 = UnitZ(Factor=multiplication_37)
load_combination_19 = Panel("UW2")
neg_36 = Negative(Value=Z_42)
loads_karamba3d_sdl_6 = LoadsKaramba3D(
    Vector=neg_36,
    Mesh=refined_mesh_7,
    ElementIdentifiers=top_element_identifiers_20,
    LCase=load_combination_19,
    mode="MeshLoad -Const.",
    menu=[buttons(off, on, off), buttons(on, on)])

panel_74 = Panel(kn_ll_kn_m2)  # "KN/m2"
factor_38 = Panel("1.6")
multiplication_38 = Multiplication(A=panel_74, B=factor_38)
Z_43 = UnitZ(Factor=multiplication_38)
neg_37 = Negative(Value=Z_43)
loads_karamba3d_ll_4 = LoadsKaramba3D(
    Vector=neg_34,
    Mesh=refined_mesh_7,
    ElementIdentifiers=top_element_identifiers_20,
    LCase=load_combination_19,
    mode="MeshLoad -Const.",
    menu=[buttons(off, off, on), buttons(on, on)])

# ----
# SW3
refined_mesh_8 = Geometry(ref_mesh)

panel_75 = Panel(kn_sdl_kn_m2)  # "KN/m2"
factor_39 = Panel("0.6")
multiplication_39 = Multiplication(A=panel_75, B=factor_39)
Z_44 = UnitZ(Factor=multiplication_39)
load_combination_20 = Panel("SW3")
top_element_identifiers_21 = Data(element_identifiers_2)
neg_38 = Negative(Value=Z_44)
loads_karamba3d_sdl_7 = LoadsKaramba3D(
    Vector=neg_38,
    Mesh=refined_mesh_8,
    ElementIdentifiers=top_element_identifiers_21,
    LCase=load_combination_20,
    mode="MeshLoad -Const.",
    menu=[buttons(off, on, off), buttons(on, on)])

top_element_identifiers_22 = Data(element_identifiers_2)

# ----
# SDL
panel_76 = Panel(kn_sdl_kn_m2)  # "KN/m2"
factor_40 = Panel("1")
multiplication_40 = Multiplication(A=panel_76, B=factor_40)
Z_45 = UnitZ(Factor=multiplication_40)
# SW1
refined_mesh_9 = Geometry(ref_mesh)
load_combination_21 = Panel("SW1")
neg_39 = Negative(Value=Z_45)
loads_karamba3d_sdl_8 = LoadsKaramba3D(
    Vector=neg_39,
    Mesh=refined_mesh_9,
    ElementIdentifiers=top_element_identifiers_22,
    LCase=load_combination_21,
    mode="MeshLoad -Const.",
    menu=[buttons(off, on, off), buttons(on, on)])

# ----
# WUL
panel_77 = Panel(kn_sdl_kn_m2)  # "KN/m2"
factor_41 = Panel("1")
multiplication_41 = Multiplication(A=panel_77, B=factor_41)
Z_46 = UnitZ(Factor=multiplication_41)
loads_karamba3d_wul = LoadsKaramba3D(
    Vector=Z_46,
    Mesh=refined_mesh_9,
    ElementIdentifiers=top_element_identifiers_22,
    LCase=load_combination_21,
    mode="MeshLoad -Const.",
    menu=[buttons(on, off, off), buttons(on, on)])

top_element_identifiers_23 = Data(element_identifiers_2)

panel_78 = Panel(kn_sdl_kn_m2)  # "KN/m2"
factor_42 = Panel("1")
multiplication_42 = Multiplication(A=panel_78, B=factor_42)
Z_47 = UnitZ(Factor=multiplication_42)
refined_mesh_10 = Geometry(ref_mesh)
load_combination_22 = Panel("UW6")
neg_40 = Negative(Value=Z_47)
loads_karamba3d_sdl_9 = LoadsKaramba3D(
    Vector=neg_40,
    Mesh=refined_mesh_10,
    ElementIdentifiers=top_element_identifiers_23,
    LCase=load_combination_22,
    mode="MeshLoad -Const.",
    menu=[buttons(off, on, off), buttons(on, on)])

# ----
# WUL
kn_wul_kn_m2 = Panel("2.8")
unit_z_3 = UnitZ(Factor=kn_wul_kn_m2)
top_element_identifiers_24 = Data(element_identifiers_2)
negative_3 = Negative(Value=unit_z_3)
refined_mesh_11 = Geometry(ref_mesh)
loads_karamba3d_wul_2 = LoadsKaramba3D(
    Vector=negative_3,
    Mesh=refined_mesh_11,
    ElementIdentifiers=top_element_identifiers_24,
    LCase="WUL",
    mode="MeshLoad -Const.",
    menu=[buttons(on, off, off), buttons(on, on)])

panel_79 = Panel(kn_wul_kn_m2)  # "KN/m2"
factor_43 = Panel("0.5")
multiplication_43 = Multiplication(A=panel_79, B=factor_43)
Z_48 = UnitZ(Factor=multiplication_43)
loads_karamba3d_wul_3 = LoadsKaramba3D(
    Vector=Z_48,
    Mesh=refined_mesh_4,
    ElementIdentifiers=top_element_identifiers_16,
    LCase=load_combination_17,
    mode="MeshLoad -Const.",
    menu=[buttons(on, off, off), buttons(on, on)])

merge_18 = Merge(Data1=loads_karamba3d_sdl_4, Data2=loads_karamba3d_ll_2, Data3=loads_karamba3d_wul_3)  # -> flatten(Result)

panel_80 = Panel(kn_wul_kn_m2)  # "KN/m2"
factor_44 = Panel("1")
multiplication_44 = Multiplication(A=panel_80, B=factor_44)
Z_49 = UnitZ(Factor=multiplication_44)
loads_karamba3d_wul_4 = LoadsKaramba3D(
    Vector=Z_49,
    Mesh=refined_mesh_8,
    ElementIdentifiers=top_element_identifiers_21,
    LCase=load_combination_20,
    mode="MeshLoad -Const.",
    menu=[buttons(on, off, off), buttons(on, on)])

# ----
# WDL
kn_wdl_kn_m2 = Panel("2.6")
unit_z_4 = UnitZ(Factor=kn_wdl_kn_m2)
top_element_identifiers_25 = Data(element_identifiers_2)
negative_4 = Negative(Value=unit_z_4)
refined_mesh_12 = Geometry(ref_mesh)
loads_karamba3d_wdl = LoadsKaramba3D(
    Vector=negative_4,
    Mesh=refined_mesh_12,
    ElementIdentifiers=top_element_identifiers_25,
    LCase="WDL",
    mode="MeshLoad -Const.",
    menu=[buttons(on, off, off), buttons(on, on)])

panel_81 = Panel(kn_wdl_kn_m2)  # "KN/m2"
factor_45 = Panel("0.5")
multiplication_45 = Multiplication(A=panel_81, B=factor_45)
Z_50 = UnitZ(Factor=multiplication_45)
neg_41 = Negative(Value=Z_50)
loads_karamba3d_wdl_2 = LoadsKaramba3D(
    Vector=neg_41,
    Mesh=refined_mesh_7,
    ElementIdentifiers=top_element_identifiers_20,
    LCase=load_combination_19,
    mode="MeshLoad -Const.",
    menu=[buttons(on, off, off), buttons(on, on)])

panel_82 = Panel(kn_wdl_kn_m2)  # "KN/m2"
factor_46 = Panel("1")
multiplication_46 = Multiplication(A=panel_82, B=factor_46)
Z_51 = UnitZ(Factor=multiplication_46)
neg_42 = Negative(Value=Z_51)
loads_karamba3d_wdl_3 = LoadsKaramba3D(
    Vector=neg_42,
    Mesh=refined_mesh_10,
    ElementIdentifiers=top_element_identifiers_23,
    LCase=load_combination_22,
    mode="MeshLoad -Const.",
    menu=[buttons(on, off, off), buttons(on, on)])

merge_19 = Merge(Data1=loads_karamba3d_sdl_6, Data2=loads_karamba3d_ll_4, Data3=loads_karamba3d_wdl_2)  # -> flatten(Result)
merge_20 = Merge(Data1=loads_karamba3d_sdl_8, Data2=loads_karamba3d_wul)
merge_21 = Merge(Data1=loads_karamba3d_sdl_9, Data2=loads_karamba3d_wdl_3)
merge_22 = Merge(Data1=loads_karamba3d_sdl_7, Data2=loads_karamba3d_wul_4)
# SW4
refined_mesh_13 = Geometry(ref_mesh)

panel_83 = Panel(kn_sdl_kn_m2)  # "KN/m2"
factor_47 = Panel("0.6")
multiplication_47 = Multiplication(A=panel_83, B=factor_47)
Z_52 = UnitZ(Factor=multiplication_47)
top_element_identifiers_26 = Data(element_identifiers_2)
neg_43 = Negative(Value=Z_52)
load_combination_23 = Panel("SW4")
loads_karamba3d_sdl_10 = LoadsKaramba3D(
    Vector=neg_43,
    Mesh=refined_mesh_13,
    ElementIdentifiers=top_element_identifiers_26,
    LCase=load_combination_23,
    mode="MeshLoad -Const.",
    menu=[buttons(off, on, off), buttons(on, on)])

factor_48 = Panel("1")
panel_84 = Panel(kn_wdl_kn_m2)  # "KN/m2"
multiplication_48 = Multiplication(A=panel_84, B=factor_48)
Z_53 = UnitZ(Factor=multiplication_48)
neg_44 = Negative(Value=Z_53)
loads_karamba3d_wdl_4 = LoadsKaramba3D(
    Vector=neg_44,
    Mesh=refined_mesh_13,
    ElementIdentifiers=top_element_identifiers_26,
    LCase=load_combination_23,
    mode="MeshLoad -Const.",
    menu=[buttons(on, off, off), buttons(on, on)])

top_element_identifiers_27 = Data(element_identifiers_2)

# ----
# SDL
kn_37 = Panel(kn_sdl_kn_m2)
factor_49 = Panel("1")
multiplication_49 = Multiplication(A=kn_37, B=factor_49)
Z_54 = UnitZ(Factor=multiplication_49)
load_combination_24 = Panel("SW2")
# SW2
refined_mesh_14 = Geometry(ref_mesh)
neg_45 = Negative(Value=Z_54)
loads_karamba3d_sdl_11 = LoadsKaramba3D(
    Vector=neg_45,
    Mesh=refined_mesh_14,
    ElementIdentifiers=top_element_identifiers_27,
    LCase=load_combination_24,
    mode="MeshLoad -Const.",
    menu=[buttons(off, on, off), buttons(on, on)])

# ----
# WDL
kn_38 = Panel(kn_wdl_kn_m2)
factor_50 = Panel("1")
multiplication_50 = Multiplication(A=kn_38, B=factor_50)
Z_55 = UnitZ(Factor=multiplication_50)
neg_46 = Negative(Value=Z_55)
loads_karamba3d_wdl_5 = LoadsKaramba3D(
    Vector=neg_46,
    Mesh=refined_mesh_14,
    ElementIdentifiers=top_element_identifiers_27,
    LCase=load_combination_24,
    mode="MeshLoad -Const.",
    menu=[buttons(on, off, off), buttons(on, on)])

top_element_identifiers_28 = Data(element_identifiers_2)

panel_85 = Panel(kn_sdl_kn_m2)  # "KN/m2"
factor_51 = Panel("1.2")
multiplication_51 = Multiplication(A=panel_85, B=factor_51)
Z_56 = UnitZ(Factor=multiplication_51)
refined_mesh_15 = Geometry(ref_mesh)
neg_47 = Negative(Value=Z_56)
load_combination_25 = Panel("UW3")
loads_karamba3d_sdl_12 = LoadsKaramba3D(
    Vector=neg_47,
    Mesh=refined_mesh_15,
    ElementIdentifiers=top_element_identifiers_28,
    LCase=load_combination_25,
    mode="MeshLoad -Const.",
    menu=[buttons(off, on, off), buttons(on, on)])

panel_86 = Panel(kn_wul_kn_m2)  # "KN/m2"
factor_52 = Panel("1")
multiplication_52 = Multiplication(A=panel_86, B=factor_52)
Z_57 = UnitZ(Factor=multiplication_52)
loads_karamba3d_wul_5 = LoadsKaramba3D(
    Vector=Z_57,
    Mesh=refined_mesh_15,
    ElementIdentifiers=top_element_identifiers_17,
    LCase=load_combination_16,
    mode="MeshLoad -Const.",
    menu=[buttons(on, off, off), buttons(on, on)])

merge_23 = Merge(Data1=loads_karamba3d_sdl_3, Data2=loads_karamba3d_wul_5)

panel_87 = Panel(kn_ll_kn_m2)  # "KN/m2"
factor_53 = Panel("1")
multiplication_53 = Multiplication(A=panel_87, B=factor_53)
Z_58 = UnitZ(Factor=multiplication_53)
neg_48 = Negative(Value=Z_58)
loads_karamba3d_ll_5 = LoadsKaramba3D(
    Vector=neg_48,
    Mesh=refined_mesh_15,
    ElementIdentifiers=top_element_identifiers_28,
    LCase=load_combination_25,
    mode="MeshLoad -Const.",
    menu=[buttons(off, off, on), buttons(on, on)])

kn_39 = Panel(kn_wul_kn_m2)
factor_54 = Panel("1")
multiplication_54 = Multiplication(A=kn_39, B=factor_54)
Z_59 = UnitZ(Factor=multiplication_54)
loads_karamba3d_wul_6 = LoadsKaramba3D(
    Vector=Z_59,
    Mesh=refined_mesh_15,
    ElementIdentifiers=top_element_identifiers_28,
    LCase=load_combination_25,
    mode="MeshLoad -Const.",
    menu=[buttons(on, off, off), buttons(on, on)])

merge_24 = Merge(Data1=loads_karamba3d_sdl_11, Data2=loads_karamba3d_wdl_5)
merge_25 = Merge(Data1=loads_karamba3d_sdl_12, Data2=loads_karamba3d_ll_5, Data3=loads_karamba3d_wul_6)  # -> flatten(Result)
merge_26 = Merge(Data1=loads_karamba3d_sdl_10, Data2=loads_karamba3d_wdl_4)
neg_49 = Negative(Value="1")
panel_88 = Panel("""SDL
LL
WUL
WDL
DStlD1
DStlD2
SW1
SW2
SW3
SW4
UD
UDL
UW1
UW2
UW3
UW4
UW5
UW6""")
Z_60 = UnitZ(Factor=neg_49)
top_element_identifiers_29 = Data(element_identifiers_2)

panel_89 = Panel(kn_sdl_kn_m2)  # "KN/m2"
factor_55 = Panel("1.2")
multiplication_55 = Multiplication(A=panel_89, B=factor_55)
Z_61 = UnitZ(Factor=multiplication_55)
refined_mesh_16 = Geometry(ref_mesh)
load_combination_26 = Panel("UW4")
neg_50 = Negative(Value=Z_61)
loads_karamba3d_sdl_13 = LoadsKaramba3D(
    Vector=neg_50,
    Mesh=refined_mesh_16,
    ElementIdentifiers=top_element_identifiers_29,
    LCase=load_combination_26,
    mode="MeshLoad -Const.",
    menu=[buttons(off, on, off), buttons(on, on)])

panel_90 = Panel(kn_ll_kn_m2)  # "KN/m2"
factor_56 = Panel("1")
multiplication_56 = Multiplication(A=panel_90, B=factor_56)
Z_62 = UnitZ(Factor=multiplication_56)
neg_51 = Negative(Value=Z_62)
loads_karamba3d_ll_6 = LoadsKaramba3D(
    Vector=neg_48,
    Mesh=refined_mesh_16,
    ElementIdentifiers=top_element_identifiers_29,
    LCase=load_combination_26,
    mode="MeshLoad -Const.",
    menu=[buttons(off, off, on), buttons(on, on)])

panel_91 = Panel(kn_wdl_kn_m2)  # "KN/m2"
factor_57 = Panel("1")
multiplication_57 = Multiplication(A=panel_91, B=factor_57)
Z_63 = UnitZ(Factor=multiplication_57)
neg_52 = Negative(Value=Z_63)
loads_karamba3d_wdl_6 = LoadsKaramba3D(
    Vector=neg_52,
    Mesh=refined_mesh_16,
    ElementIdentifiers=top_element_identifiers_29,
    LCase=load_combination_26,
    mode="MeshLoad -Const.",
    menu=[buttons(on, off, off), buttons(on, on)])

loads_2 = LoadsKaramba3D(Vector=Z_60, LCase=panel_88, mode="Gravity")
# UD
refined_mesh_17 = Geometry(ref_mesh)
top_element_identifiers_30 = Data(element_identifiers_2)

# ----
# SDL
kn_40 = Panel(kn_sdl_kn_m2)
factor_58 = Panel("1.4")
multiplication_58 = Multiplication(A=kn_40, B=factor_58)
Z_64 = UnitZ(Factor=multiplication_58)
load_combination_27 = Panel("UD")
neg_53 = Negative(Value=Z_64)
loads_karamba3d_sdl_14 = LoadsKaramba3D(
    Vector=neg_53,
    Mesh=refined_mesh_17,
    ElementIdentifiers=top_element_identifiers_30,
    LCase=load_combination_27,
    mode="MeshLoad -Const.",
    menu=[buttons(off, on, off), buttons(on, on)])

# ----
# UDL
top_element_identifiers_31 = Data(element_identifiers_2)
refined_mesh_18 = Geometry(ref_mesh)

# ----
# SDL
kn_41 = Panel(kn_sdl_kn_m2)
factor_59 = Panel("1.2")
multiplication_59 = Multiplication(A=kn_41, B=factor_59)
Z_65 = UnitZ(Factor=multiplication_59)
neg_54 = Negative(Value=Z_65)
load_combination_28 = Panel("UDL")
loads_karamba3d_sdl_15 = LoadsKaramba3D(
    Vector=neg_54,
    Mesh=refined_mesh_18,
    ElementIdentifiers=top_element_identifiers_31,
    LCase=load_combination_28,
    mode="MeshLoad -Const.",
    menu=[buttons(off, on, off), buttons(on, on)])

kn_42 = Panel(kn_ll_kn_m2)
factor_60 = Panel("1.6")
multiplication_60 = Multiplication(A=kn_42, B=factor_60)
Z_66 = UnitZ(Factor=multiplication_60)
neg_55 = Negative(Value=Z_66)
loads_karamba3d_ll_7 = LoadsKaramba3D(
    Vector=neg_55,
    Mesh=refined_mesh_18,
    ElementIdentifiers=top_element_identifiers_31,
    LCase=load_combination_28,
    mode="MeshLoad -Const.",
    menu=[buttons(off, off, on), buttons(on, on)])

merge_27 = Merge(Data1=loads_karamba3d_sdl_13, Data2=loads_karamba3d_ll_6, Data3=loads_karamba3d_wdl_6)  # -> flatten(Result)
merge_28 = Merge(Data1=loads_karamba3d_sdl_14)
merge_29 = Merge(Data1=loads_karamba3d_sdl_15, Data2=loads_karamba3d_ll_7)  # -> flatten(Result)

wul_2 = Data(loads_karamba3d_wul_2)
dstld2_2 = Data(merge_17)
wdl_2 = Data(loads_karamba3d_wdl)
dstld1_2 = Data(merge_16)
sw1_2 = Data(merge_20)
sw4_2 = Data(merge_26)
ud_2 = Data(merge_28)
uw1_2 = Data(merge_18)
uw2_2 = Data(merge_19)
# Load_Combinations
sdl_2 = Data(loads_karamba3d_sdl)
ll_2 = Data(loads_karamba3d_ll)
sw2_2 = Data(merge_24)
sw3_2 = Data(merge_22)
udl_2 = Data(merge_29)
uw3_2 = Data(merge_25)
uw4_2 = Data(merge_27)
uw5_2 = Data(merge_23)
uw6_2 = Data(merge_21)
sw_2 = Data(loads_2)
merge_30 = Merge(
    Data1=sdl_2,
    Data2=ll_2,
    Data3=wul_2,
    Data4=wdl_2,
    Data5=dstld1_2,
    Data6=dstld2_2,
    Data7=sw1_2,
    Data8=sw2_2,
    Data9=sw3_2,
    Data10=sw4_2,
    Data11=ud_2,
    Data12=udl_2,
    Data13=uw1_2,
    Data14=uw2_2,
    Data15=uw3_2,
    Data16=uw4_2,
    Data17=uw5_2,
    Data18=uw6_2,
    Data19=sw_2)  # -> flatten(Result)
