# Grasshopper definition GH_ETABS_simple_pusher.gh (Grasshopper 1.0.7)
# plug-ins: BH.UI.Grasshopper

support_connectors = Geometry([<curve referenced from the Rhino model> x47])

# ---- group: Create_Adapter
# Stream_list: Main_Top_Truss_members         = 0
# Main_Bottom_Truss_members      = 1
# Main_Truss_web_members         = 2
# Main_Truss_Beam_Top_members    = 3
# Main_Truss_Beam_Bottom_members = 4
boolean_toggle = BooleanToggle(False)
# Simple Grasshopper to ETABS BHoM Pusher
etabsadapter = ETABSAdapter(Active=boolean_toggle, Component="{ ..ctor")

# ----
wall_lines = Geometry([<curve referenced from the Rhino model> x48])
steel_column_lines = Geometry([<curve referenced from the Rhino model> x18])
explode = Explode(Curve=wall_lines, Recursive=True)  # -> Segments, Vertices
explode_2 = Explode(Curve=steel_column_lines, Recursive=True)  # -> Segments, Vertices
end_points = EndPoints(Curve=explode.Segments)  # -> Start, End
end_points_2 = EndPoints(Curve=explode_2.Segments)  # -> Start, End
line = Line(StartPoint=end_points_2.Start, EndPoint=end_points_2.End)
line_2 = Line(StartPoint=end_points.Start, EndPoint=end_points.End)
chs = CHS(
    {"CHS 21.3x2.6": 0, "CHS 21.3x2.9": 1, "CHS 21.3x3.2": 2, "CHS 26.9x2.6": 3, "CHS 26.9x2.9": 4, "CHS 26.9x3.2": 5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}, selected="CHS 60.3x6.3": 36,
    Component="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",
    Selection=36)
chs_2 = CHS(
    {"CHS 21.3x2.6": 0, "CHS 21.3x2.9": 1, "CHS 21.3x3.2": 2, "CHS 26.9x2.6": 3, "CHS 26.9x2.9": 4, "CHS 26.9x3.2": 5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}, selected="CHS 60.3x8.0": 38,
    Component="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",
    Selection=38)
line_3 = Line(flatten(line))
line_4 = Line(flatten(line_2))
bar = Bar(
    Line=line_3,
    SectionProperty=chs,
    OrientationAngle=0,
    FeaType="{ \"_t\" : \"System.Enum\", \"TypeName\" : { \"_t\" : \"System.Type\", \"Name\" : \"BH.oM.Structure.Elements.BarFEAType\", \"_bhomVersion\" : \"5.1\" }, \"Value\" : \"Flexural\", \"_bhomVersion\" : \"5.1\" }",
    Component="{ .Bar")
bar_2 = Bar(
    Line=line_4,
    SectionProperty=chs_2,
    OrientationAngle=0,
    FeaType="{ \"_t\" : \"System.Enum\", \"TypeName\" : { \"_t\" : \"System.Type\", \"Name\" : \"BH.oM.Structure.Elements.BarFEAType\", \"_bhomVersion\" : \"5.1\" }, \"Value\" : \"Flexural\", \"_bhomVersion\" : \"5.1\" }",
    Component="{ .Bar")

geometry = Geometry([<curve referenced from the Rhino model> x6])
explode_3 = Explode(Curve=geometry, Recursive=True)  # -> Segments, Vertices
end_points_3 = EndPoints(Curve=explode_3.Segments)  # -> Start, End
main_truss_beam_bottom_members = Geometry([<curve referenced from the Rhino model> x91])

# ---- group: Reference_operations
main_truss_beam_top_members = Geometry([<curve referenced from the Rhino model> x92])
main_bottom_truss_members = Geometry([<curve referenced from the Rhino model> x714])
main_top_truss_members = Geometry([<curve referenced from the Rhino model> x627])
main_truss_web_members = Geometry([<curve referenced from the Rhino model> x899])
sec_bottom_truss_members = Geometry([<curve referenced from the Rhino model> x109])
# Stream_list: Sec_Top_Truss_members         = 0
# Sec_Bottom_Truss_members      = 1
# Sec_Truss_web_members         = 2
sec_top_truss_members = Geometry([<curve referenced from the Rhino model> x102])
sec_truss_web_members = Geometry([<curve referenced from the Rhino model> x105])
chs_3 = CHS(
    {"CHS 21.3x2.6": 0, "CHS 21.3x2.9": 1, "CHS 21.3x3.2": 2, "CHS 26.9x2.6": 3, "CHS 26.9x2.9": 4, "CHS 26.9x3.2": 5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}, selected="CHS 244.5x11.0": 121,
    Component="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",
    Selection=121)
chs_4 = CHS(
    {"CHS 21.3x2.6": 0, "CHS 21.3x2.9": 1, "CHS 21.3x3.2": 2, "CHS 26.9x2.6": 3, "CHS 26.9x2.9": 4, "CHS 26.9x3.2": 5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}, selected="CHS 244.5x10.0": 120,
    Component="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",
    Selection=120)
chs_5 = CHS(
    {"CHS 21.3x2.6": 0, "CHS 21.3x2.9": 1, "CHS 21.3x3.2": 2, "CHS 26.9x2.6": 3, "CHS 26.9x2.9": 4, "CHS 26.9x3.2": 5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}, selected="CHS 244.5x11.0": 121,
    Component="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",
    Selection=121)
chs_6 = CHS(
    {"CHS 21.3x2.6": 0, "CHS 21.3x2.9": 1, "CHS 21.3x3.2": 2, "CHS 26.9x2.6": 3, "CHS 26.9x2.9": 4, "CHS 26.9x3.2": 5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}, selected="CHS 244.5x7.1": 118,
    Component="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",
    Selection=118)
chs_7 = CHS(
    {"CHS 21.3x2.6": 0, "CHS 21.3x2.9": 1, "CHS 21.3x3.2": 2, "CHS 26.9x2.6": 3, "CHS 26.9x2.9": 4, "CHS 26.9x3.2": 5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}, selected="CHS 114.3x5.0": 71,
    Component="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",
    Selection=71)
chs_8 = CHS(
    {"CHS 21.3x2.6": 0, "CHS 21.3x2.9": 1, "CHS 21.3x3.2": 2, "CHS 26.9x2.6": 3, "CHS 26.9x2.9": 4, "CHS 26.9x3.2": 5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}, selected="CHS 244.5x10.0": 120,
    Component="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",
    Selection=120)
chs_9 = CHS(
    {"CHS 21.3x2.6": 0, "CHS 21.3x2.9": 1, "CHS 21.3x3.2": 2, "CHS 26.9x2.6": 3, "CHS 26.9x2.9": 4, "CHS 26.9x3.2": 5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}, selected="CHS 244.5x10.0": 120,
    Component="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",
    Selection=120)
chs_10 = CHS(
    {"CHS 21.3x2.6": 0, "CHS 21.3x2.9": 1, "CHS 21.3x3.2": 2, "CHS 26.9x2.6": 3, "CHS 26.9x2.9": 4, "CHS 26.9x3.2": 5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}, selected="CHS 114.3x5.0": 71,
    Component="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",
    Selection=71)
line_5 = Line(main_top_truss_members)
line_6 = Line(main_bottom_truss_members)
line_7 = Line(main_truss_web_members)
line_8 = Line(main_truss_beam_bottom_members)
line_9 = Line(main_truss_beam_top_members)
line_10 = Line(sec_top_truss_members)
line_11 = Line(sec_bottom_truss_members)
line_12 = Line(sec_truss_web_members)
value_list = ValueList({"Main_Top_Truss_members": 0, "Main_Bottom_Truss_members": 1, "Main_Truss_web_members": 2, "Main_Truss_Beam_Top_members": 3, "Main_Truss_Beam_Bottom_members": 4}, selected="Main_Truss_Beam_Bottom_members")
value_list_2 = ValueList({"Sec_Top_Truss_members": 0, "Sec_Bottom_Truss_members": 1, "Sec_Truss_web_members": 2}, selected="Sec_Truss_web_members")
bar_3 = Bar(
    Line=line_5,
    SectionProperty=chs_4,
    OrientationAngle=0,
    FeaType="{ \"_t\" : \"System.Enum\", \"TypeName\" : { \"_t\" : \"System.Type\", \"Name\" : \"BH.oM.Structure.Elements.BarFEAType\", \"_bhomVersion\" : \"5.1\" }, \"Value\" : \"Flexural\", \"_bhomVersion\" : \"5.1\" }",
    Component="{ .Bar")
bar_4 = Bar(
    Line=line_6,
    SectionProperty=chs_5,
    OrientationAngle=0,
    FeaType="{ \"_t\" : \"System.Enum\", \"TypeName\" : { \"_t\" : \"System.Type\", \"Name\" : \"BH.oM.Structure.Elements.BarFEAType\", \"_bhomVersion\" : \"5.1\" }, \"Value\" : \"Flexural\", \"_bhomVersion\" : \"5.1\" }",
    Component="{ .Bar")
bar_5 = Bar(
    Line=line_8,
    SectionProperty=chs_6,
    OrientationAngle=0,
    FeaType="{ \"_t\" : \"System.Enum\", \"TypeName\" : { \"_t\" : \"System.Type\", \"Name\" : \"BH.oM.Structure.Elements.BarFEAType\", \"_bhomVersion\" : \"5.1\" }, \"Value\" : \"Flexural\", \"_bhomVersion\" : \"5.1\" }",
    Component="{ .Bar")
bar_6 = Bar(
    Line=line_7,
    SectionProperty=chs_7,
    OrientationAngle=0,
    FeaType="{ \"_t\" : \"System.Enum\", \"TypeName\" : { \"_t\" : \"System.Type\", \"Name\" : \"BH.oM.Structure.Elements.BarFEAType\", \"_bhomVersion\" : \"5.1\" }, \"Value\" : \"Flexural\", \"_bhomVersion\" : \"5.1\" }",
    Component="{ .Bar")
bar_7 = Bar(
    Line=line_9,
    SectionProperty=chs_8,
    OrientationAngle=0,
    FeaType="{ \"_t\" : \"System.Enum\", \"TypeName\" : { \"_t\" : \"System.Type\", \"Name\" : \"BH.oM.Structure.Elements.BarFEAType\", \"_bhomVersion\" : \"5.1\" }, \"Value\" : \"Flexural\", \"_bhomVersion\" : \"5.1\" }",
    Component="{ .Bar")
bar_8 = Bar(
    Line=line_10,
    SectionProperty=chs_9,
    OrientationAngle=0,
    FeaType="{ \"_t\" : \"System.Enum\", \"TypeName\" : { \"_t\" : \"System.Type\", \"Name\" : \"BH.oM.Structure.Elements.BarFEAType\", \"_bhomVersion\" : \"5.1\" }, \"Value\" : \"Flexural\", \"_bhomVersion\" : \"5.1\" }",
    Component="{ .Bar")
bar_9 = Bar(
    Line=line_11,
    SectionProperty=chs_3,
    OrientationAngle=0,
    FeaType="{ \"_t\" : \"System.Enum\", \"TypeName\" : { \"_t\" : \"System.Type\", \"Name\" : \"BH.oM.Structure.Elements.BarFEAType\", \"_bhomVersion\" : \"5.1\" }, \"Value\" : \"Flexural\", \"_bhomVersion\" : \"5.1\" }",
    Component="{ .Bar")
bar_10 = Bar(
    Line=line_12,
    SectionProperty=chs_10,
    OrientationAngle=0,
    FeaType="{ \"_t\" : \"System.Enum\", \"TypeName\" : { \"_t\" : \"System.Type\", \"Name\" : \"BH.oM.Structure.Elements.BarFEAType\", \"_bhomVersion\" : \"5.1\" }, \"Value\" : \"Flexural\", \"_bhomVersion\" : \"5.1\" }",
    Component="{ .Bar")
stream_filter = StreamFilter(Gate=value_list_2, Stream0=bar_8, Stream1=bar_9, Stream2=bar_10)
stream_filter_2 = StreamFilter(Gate=value_list, Stream0=bar_3, Stream1=bar_4, Stream2=bar_6, Stream3=bar_7, Stream4=bar_5)
merge = Merge(Data1=stream_filter_2, Data2=stream_filter)

# ----
line_13 = Line(StartPoint=end_points_3.Start, EndPoint=end_points_3.End)
chs_11 = CHS(
    {"CHS 21.3x2.6": 0, "CHS 21.3x2.9": 1, "CHS 21.3x3.2": 2, "CHS 26.9x2.6": 3, "CHS 26.9x2.9": 4, "CHS 26.9x3.2": 5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}, selected="CHS 273.0x6.3": 127,
    Component="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",
    Selection=127)
line_14 = Line(flatten(line_13))
bar_11 = Bar(
    Line=line_14,
    SectionProperty=chs_11,
    OrientationAngle=0,
    FeaType="{ \"_t\" : \"System.Enum\", \"TypeName\" : { \"_t\" : \"System.Type\", \"Name\" : \"BH.oM.Structure.Elements.BarFEAType\", \"_bhomVersion\" : \"5.1\" }, \"Value\" : \"Flexural\", \"_bhomVersion\" : \"5.1\" }",
    Component="{ .Bar")

# ---- group: Push_to_ETABS
push = Push(
    Adapter=etabsadapter,
    Objects=flatten(bar_11),
    PushType="{ \"_t\" : \"System.Enum\", \"TypeName\" : { \"_t\" : \"System.Type\", \"Name\" : \"BH.oM.Adapter.PushType\", \"_bhomVersion\" : \"5.1\" }, \"Value\" : \"AdapterDefault\", \"_bhomVersion\" : \"5.1\" }",
    Active=Toggle(True),
    Component="{ .Push")  # -> Objects, Success
