# Grasshopper definition Truss_Creation_from_Reference_surface_31052022_AS.gh (Grasshopper 1.0.7)
# plug-ins: BullAnt, Pufferfish, Karamba3D, Human, EleFront, MetaHopper

# ---- group: Inputs
# Inputs
average_roof_dimension = Slider(12, range=0..100)
end_depth_near_column = Slider(0.5, range=0..1)
offset_from_boundary = Slider(2.4, range=0..10)
input_4_sided_curve = Geometry(<curve referenced from the Rhino model>)
ceiling_depth = Slider(0.225, range=0..1)
roof_depth = Slider(0.35, range=0..1)
end_depth_near_column_2 = Slider(0.5, range=0..1)
truss_breadth_at_ends = Slider(0.1, range=0..0.1)
grid_size = Slider(1.2, range=0..10)
truss_member_size = Slider(0.05, range=0..0.1)
truss_depth_at_ends = Slider(0.2, range=0..1)
web_and_flange_thickness = Slider(0.005, range=0..0.01)
offset = Data(offset_from_boundary)
end_depth_near_column_3 = Data(end_depth_near_column)

# ---- group: Document_information / Update everytime you add a group
# Script Information (V1)
get_groups = GetGroups()  # -> Groups, GroupStyles, Nickname, Color

# ---- group: Document_information
# Notes: Install Metahopper Plugin to enable the document information group.
# https://www.food4rhino.com/en/app/metahopper
# Brief Description: This Script is developed to make a modular Truss from a given surface or outline
# The input surface should preferrably be a multiple of the grid size defined in the script
# Versioning: Please update the version when you make a change
# Version 1 : 31052022
document_info = DocumentInfo(AutoUpdate=False, Recursive=False)  # -> DocumentName, DocumentFilePath, Components, Params, _3rdPartyAssemblies
list_of_plugins_used = Panel(document_info._3rdPartyAssemblies)
add_group_name = Panel("Process")
add_group_name_2 = Panel("Solver")
add_group_name_3 = Panel("Inputs")
match_text = MatchText(Text=add_group_name_2, Pattern=get_groups.Nickname, Case=True)
match_text_2 = MatchText(Text=add_group_name, Pattern=get_groups.Nickname, Case=True)
match_text_3 = MatchText(Text=add_group_name_3, Pattern=get_groups.Nickname, Case=True)
cull_pattern = CullPattern(List=get_groups.Groups, CullPattern=match_text)
cull_pattern_2 = CullPattern(List=get_groups.Groups, CullPattern=match_text_2)
cull_pattern_3 = CullPattern(List=get_groups.Groups, CullPattern=match_text_3)
set_group_properties = SetGroupProperties(Group=cull_pattern_2, Color=ColourSwatch(SwatchColor=RGBA(157, 59, 237, 93)))
set_group_properties_2 = SetGroupProperties(Group=cull_pattern_3, Color=ColourSwatch(SwatchColor=RGBA(135, 235, 14, 152)))
set_group_properties_3 = SetGroupProperties(Group=cull_pattern, Color=ColourSwatch(SwatchColor=RGBA(235, 26, 26, 93)))
add_group_name_4 = Panel("Vizualisation")
add_group_name_5 = Panel("Output")
add_group_name_6 = Panel("Karamba_analysis")
match_text_4 = MatchText(Text=add_group_name_4, Pattern=get_groups.Nickname, Case=True)
match_text_5 = MatchText(Text=add_group_name_5, Pattern=get_groups.Nickname, Case=True)
match_text_6 = MatchText(Text=add_group_name_6, Pattern=get_groups.Nickname, Case=True)
cull_pattern_4 = CullPattern(List=get_groups.Groups, CullPattern=match_text_4)
cull_pattern_5 = CullPattern(List=get_groups.Groups, CullPattern=match_text_5)
cull_pattern_6 = CullPattern(List=get_groups.Groups, CullPattern=match_text_6)
set_group_properties_4 = SetGroupProperties(Group=cull_pattern_5, Color=ColourSwatch(SwatchColor=RGBA(26, 168, 235, 93)))
set_group_properties_5 = SetGroupProperties(Group=cull_pattern_4, Color=ColourSwatch(SwatchColor=RGBA(216, 235, 14, 152)))
set_group_properties_6 = SetGroupProperties(Group=cull_pattern_6, Color=ColourSwatch(SwatchColor=RGBA(14, 88, 235, 152)))

# ---- group: Process
data = Data(average_roof_dimension)
# Average Roof Data Creation
dom = Domain(DomainStart=expr("-x/2", data), DomainEnd=expr("x/2", data))
dom_2 = Domain(DomainStart=expr("-x/2", data), DomainEnd=expr("x/2", data))
rectangle = Rectangle(Plane=PlaneXY(0, 0, 0), XSize=dom, YSize=dom_2, Radius=0)  # -> Rectangle, Length

base12mx12m_surface = Curve(rectangle.Rectangle)
explode = Explode(Curve=base12mx12m_surface, Recursive=True)  # -> Segments, Vertices
explode_tree = ExplodeTree(Data=simplify(graft(explode.Segments)))  # -> Branch0, Branch1, Branch2, Branch3

curve_middle = CurveMiddle(Curve=explode_tree.Branch0)
curve_middle_2 = CurveMiddle(Curve=explode_tree.Branch2)
line = Line(StartPoint=curve_middle, EndPoint=curve_middle_2)
negative = Negative(Value=offset)
unit_z = UnitZ(Factor=1)
offset_curve = OffsetCurve(Curve=base12mx12m_surface, Distance=negative, Corners=1)
curve_middle_3 = CurveMiddle(Curve=line)
negative_2 = Negative(Value=unit_z)
unit_z_2 = UnitZ(Factor=end_depth_near_column_3)
geometry = Geometry(offset_curve)
curve_line = CurveLine(Curve=geometry, Line=line)  # -> Points, Params, Count
negative_3 = Negative(Value=unit_z_2)
move = Move(Geometry=curve_line.Points, Motion=negative_3)  # -> Geometry, Transform
entwine = Entwine(Branch00=flatten(curve_middle), Branch01=flatten(curve_middle_2), Branch02=flatten(move.Geometry), FlattenInputs=True)  # -> flatten(Result)
curve_closest_point = CurveClosestPoint(Point=entwine, Curve=line)  # -> Point, Parameter, Distance
sort_list = SortList(Keys=curve_closest_point.Parameter, ValuesValuesA=entwine)  # -> Keys, ValuesValuesA
interpolate = Interpolate(Vertices=sort_list.ValuesValuesA, Degree=3, Periodic=False, KnotStyle=1)  # -> Curve, Length, Domain
merge = Merge(Data1=flatten(explode_tree.Branch1), Data2=flatten(interpolate.Curve), Data3=flatten(explode_tree.Branch3))  # -> flatten(Result)

curve_middle_4 = CurveMiddle(Curve=explode_tree.Branch3)
curve_middle_5 = CurveMiddle(Curve=explode_tree.Branch1)
unit_z_3 = UnitZ(Factor=end_depth_near_column_3)
line_2 = Line(StartPoint=curve_middle_5, EndPoint=curve_middle_4)
negative_4 = Negative(Value=unit_z_3)
curve_middle_6 = CurveMiddle(Curve=line_2)
unit_z_4 = UnitZ(Factor=1)
geometry_2 = Geometry(offset_curve)
curve_line_2 = CurveLine(Curve=geometry_2, Line=line_2)  # -> Points, Params, Count
negative_5 = Negative(Value=unit_z_4)
move_2 = Move(Geometry=curve_line_2.Points, Motion=negative_4)  # -> Geometry, Transform
entwine_2 = Entwine(
    Branch00=flatten(curve_middle_5),
    Branch01=flatten(curve_middle_4),
    Branch02=flatten(move_2.Geometry),
    FlattenInputs=True)  # -> flatten(Result)
curve_closest_point_2 = CurveClosestPoint(Point=entwine_2, Curve=line_2)  # -> Point, Parameter, Distance
sort_list_2 = SortList(Keys=curve_closest_point_2.Parameter, ValuesValuesA=entwine_2)  # -> Keys, ValuesValuesA
interpolate_2 = Interpolate(Vertices=sort_list_2.ValuesValuesA, Degree=3, Periodic=False, KnotStyle=1)  # -> Curve, Length, Domain
merge_2 = Merge(Data1=flatten(explode_tree.Branch0), Data2=flatten(interpolate_2.Curve), Data3=flatten(explode_tree.Branch2))  # -> flatten(Result)

number_slider = Slider(0.5, range=0..1)
shatter = Shatter(Curve=reparameterize(interpolate_2.Curve), Parameters=number_slider)
shatter_2 = Shatter(Curve=reparameterize(interpolate.Curve), Parameters=number_slider)
list_item = ListItem(List=shatter_2, Index=0, Wrap=True)
list_item_2 = ListItem(List=shatter, Index=0, Wrap=True)

network_surface = NetworkSurface(CurvesU=merge, CurvesV=merge_2, Continuity=2)

area = Area(Geometry=base12mx12m_surface)  # -> Area, Centroid
curve_curve = CurveCurve(CurveA=interpolate.Curve, CurveB=interpolate_2.Curve)  # -> Points, ParamsA, ParamsB
distance = Distance(PointA=area.Centroid, PointB=curve_curve.Points)

average_surface = Geometry(network_surface)

# ----
depth_at_which_12m_roof_ends = Panel(distance)
depth_at_middle_average_roof = Data(distance)

# ---- group: Process
y_avg_curve = Data(list_item)
x_avg_curve = Data(list_item_2)

# Structural Surface Creation
input_4_side_curve = Curve(input_4_sided_curve)
explode_2 = Explode(Curve=input_4_side_curve, Recursive=True)  # -> Segments, Vertices
length = Length(Curve=explode_2.Segments)
sort_list_3 = SortList(Keys=length, ValuesValuesA=explode_2.Segments)  # -> Keys, ValuesValuesA
sort_list_4 = SortList(Keys=explode_2.Segments, ValuesValuesA=length)  # -> Keys, ValuesValuesA
list_item_3 = ListItem(List=sort_list_3.ValuesValuesA, Index=0, Wrap=True)  # -> Item, Item1, Item2, Item3
x_curve = Data(list_item_3.Item)
list_item_4 = ListItem(List=sort_list_4.ValuesValuesA, Index=0, Wrap=True)  # -> Item1, Item

# ---- group: Inputs
depth_at_middle_average_roof_2 = Data(depth_at_middle_average_roof)
x_avg_curve_2 = Data(x_avg_curve)
x_curve_2 = Data(x_curve)

# ----
y_avg_curve_2 = Data(y_avg_curve)
y_curve = Data(list_item_3.Item3)

# ---- group: Process
average_roof_dimension_2 = Data(average_roof_dimension)
x_length = Data(list_item_4.Item)

average_roof_dimension_3 = Data(average_roof_dimension)
y_length = Data(list_item_4.Item1)

unit_z_5 = UnitZ(Factor=depth_at_middle_average_roof_2)
division = Division(A=average_roof_dimension_2, B="2")
end_points = EndPoints(Curve=x_curve_2)  # -> Start, End
end_points_2 = EndPoints(Curve=x_avg_curve_2)  # -> Start, End
end_points_3 = EndPoints(Curve=x_curve_2)  # -> Start, End
negative_6 = Negative(Value=unit_z_5)
vector_2pt = Vector2Pt(PointA=end_points_3.Start, PointB=end_points_3.End, Unitize=False)  # -> Vector, Length
line_sdl = LineSDL(Start=end_points_3.Start, Direction=vector_2pt.Vector, Length=division)
vector_2pt_2 = Vector2Pt(PointA=end_points_2.Start, PointB=end_points_2.End, Unitize=False)  # -> Vector, Length
geometry_3 = Geometry(end_points_2.End)
end_points_4 = EndPoints(Curve=line_sdl)  # -> Start, End
move_3 = Move(Geometry=end_points_4.End, Motion=negative_6)  # -> Geometry, Transform
vector_2pt_3 = Vector2Pt(PointA=end_points.Start, PointB=move_3.Geometry, Unitize=False)  # -> Vector, Length
orient_direction = OrientDirection(
    Geometry=x_avg_curve_2,
    PointA=geometry_3,
    DirectionA=vector_2pt_2.Vector,
    PointB=move_3.Geometry,
    DirectionB=vector_2pt_3.Vector)  # -> Geometry, Transform
perp_frame = PerpFrame(Curve=reparameterize(x_curve_2), Parameter=Slider(0.5, range=0..1))

equality = Equality(FirstNumber=x_length, SecondNumber=average_roof_dimension_2)  # -> Equality, Inequality
smaller_than = SmallerThan(FirstNumber=x_length, SecondNumber=average_roof_dimension_2)  # -> SmallerThan, OrEqualTo
larger_than = LargerThan(FirstNumber=x_length, SecondNumber=average_roof_dimension_2)  # -> LargerThan, OrEqualTo
series = Series(Start=0, Step=1, Count=Slider(3, range=0..10))
entwine_3 = Entwine(Branch00=equality.Equality, Branch01=smaller_than.SmallerThan, Branch02=larger_than.LargerThan, FlattenInputs=True)  # -> flatten(Result)
cull_pattern_7 = CullPattern(List=series, CullPattern=entwine_3)

unit_z_6 = UnitZ(Factor=depth_at_middle_average_roof_2)
division_2 = Division(A=average_roof_dimension_2, B="2")
end_points_5 = EndPoints(Curve=y_curve)  # -> Start, End
end_points_6 = EndPoints(Curve=y_avg_curve_2)  # -> Start, End
end_points_7 = EndPoints(Curve=y_curve)  # -> Start, End
negative_7 = Negative(Value=unit_z_6)
vector_2pt_4 = Vector2Pt(PointA=end_points_7.Start, PointB=end_points_7.End, Unitize=False)  # -> Vector, Length
line_sdl_2 = LineSDL(Start=end_points_7.Start, Direction=vector_2pt_4.Vector, Length=division_2)
vector_2pt_5 = Vector2Pt(PointA=end_points_6.Start, PointB=end_points_6.End, Unitize=False)  # -> Vector, Length
geometry_4 = Geometry(end_points_6.End)
end_points_8 = EndPoints(Curve=line_sdl_2)  # -> Start, End
move_4 = Move(Geometry=end_points_8.End, Motion=negative_7)  # -> Geometry, Transform
vector_2pt_6 = Vector2Pt(PointA=end_points_5.Start, PointB=move_4.Geometry, Unitize=False)  # -> Vector, Length
orient_direction_2 = OrientDirection(
    Geometry=y_avg_curve_2,
    PointA=geometry_4,
    DirectionA=vector_2pt_5.Vector,
    PointB=move_4.Geometry,
    DirectionB=vector_2pt_6.Vector)  # -> Geometry, Transform
perp_frame_2 = PerpFrame(Curve=reparameterize(y_curve), Parameter=Slider(0.5, range=0..1))

equality_2 = Equality(FirstNumber=y_length, SecondNumber=average_roof_dimension_3)  # -> Equality, Inequality
smaller_than_2 = SmallerThan(FirstNumber=y_length, SecondNumber=average_roof_dimension_3)  # -> SmallerThan, OrEqualTo
larger_than_2 = LargerThan(FirstNumber=y_length, SecondNumber=average_roof_dimension_3)  # -> LargerThan, OrEqualTo
number_slider_2 = Slider(3, range=0..10)

series_2 = Series(Start=0, Step=1, Count=number_slider_2)
entwine_4 = Entwine(Branch00=equality_2.Equality, Branch01=smaller_than_2.SmallerThan, Branch02=larger_than_2.LargerThan, FlattenInputs=True)  # -> flatten(Result)
cull_pattern_8 = CullPattern(List=series_2, CullPattern=entwine_4)

end_points_9 = EndPoints(Curve=orient_direction.Geometry)  # -> Start, End
mirror = Mirror(Geometry=orient_direction.Geometry, Plane=perp_frame)  # -> Geometry, Transform
curve_curve_2 = CurveCurve(CurveA=orient_direction.Geometry, CurveB=mirror.Geometry)  # -> Points, ParamsA, ParamsB
shatter_3 = Shatter(Curve=mirror.Geometry, Parameters=curve_curve_2.ParamsB)
shatter_4 = Shatter(Curve=orient_direction.Geometry, Parameters=curve_curve_2.ParamsA)
list_item_5 = ListItem(List=shatter_4, Index="0", Wrap=True)
list_item_6 = ListItem(List=shatter_3, Index="0", Wrap=True)
end_points_10 = EndPoints(Curve=mirror.Geometry)  # -> Start, End
merge_3 = Merge(Data1=list_item_5, Data2=list_item_6)
line_3 = Line(StartPoint=end_points_9.End, EndPoint=end_points_10.End)
gate = Data(cull_pattern_8)
merge_4 = Merge(Data1=orient_direction.Geometry, Data2=mirror.Geometry)
merge_5 = Merge(Data1=orient_direction.Geometry, Data2=line_3, Data3=mirror.Geometry)
stream_filter = StreamFilter(Gate=cull_pattern_7, Stream0=merge_4, Stream1=merge_3, Stream2=merge_5)
join_curves = JoinCurves(Curves=stream_filter, Preserve=False)

end_points_11 = EndPoints(Curve=orient_direction_2.Geometry)  # -> Start, End
mirror_2 = Mirror(Geometry=orient_direction_2.Geometry, Plane=perp_frame_2)  # -> Geometry, Transform
curve_curve_3 = CurveCurve(CurveA=orient_direction_2.Geometry, CurveB=mirror_2.Geometry)  # -> Points, ParamsA, ParamsB
shatter_5 = Shatter(Curve=mirror_2.Geometry, Parameters=curve_curve_3.ParamsB)
shatter_6 = Shatter(Curve=orient_direction_2.Geometry, Parameters=curve_curve_3.ParamsA)
list_item_7 = ListItem(List=shatter_6, Index="0", Wrap=True)
list_item_8 = ListItem(List=shatter_5, Index="0", Wrap=True)
end_points_12 = EndPoints(Curve=mirror_2.Geometry)  # -> Start, End
merge_6 = Merge(Data1=list_item_7, Data2=list_item_8)
line_4 = Line(StartPoint=end_points_11.End, EndPoint=end_points_12.End)
merge_7 = Merge(Data1=orient_direction_2.Geometry, Data2=mirror_2.Geometry)
merge_8 = Merge(Data1=orient_direction_2.Geometry, Data2=line_4, Data3=mirror_2.Geometry)
gate_2 = Data(cull_pattern_7)
stream_filter_2 = StreamFilter(Gate=cull_pattern_8, Stream0=merge_7, Stream1=merge_6, Stream2=merge_8)
join_curves_2 = JoinCurves(Curves=stream_filter_2, Preserve=False)

control_points = ControlPoints(Curve=y_curve)  # -> Points, Weights, Knots
curve_closest_point_3 = CurveClosestPoint(Point=control_points.Points, Curve=x_curve_2)  # -> Point, Parameter, Distance
sort_list_5 = SortList(Keys=curve_closest_point_3.Distance, ValuesValuesA=control_points.Points)  # -> Keys, ValuesValuesA
list_item_9 = ListItem(List=sort_list_5.ValuesValuesA, Index=0, Wrap=True)  # -> Item, Item1
vector_2pt_7 = Vector2Pt(PointA=list_item_9.Item, PointB=list_item_9.Item1, Unitize=False)  # -> Vector, Length

control_points_2 = ControlPoints(Curve=x_curve_2)  # -> Points, Weights, Knots
curve_closest_point_4 = CurveClosestPoint(Point=control_points_2.Points, Curve=y_curve)  # -> Point, Parameter, Distance
sort_list_6 = SortList(Keys=curve_closest_point_4.Distance, ValuesValuesA=control_points_2.Points)  # -> Keys, ValuesValuesA
list_item_10 = ListItem(List=sort_list_6.ValuesValuesA, Index=0, Wrap=True)  # -> Item, Item1
vector_2pt_8 = Vector2Pt(PointA=list_item_10.Item, PointB=list_item_10.Item1, Unitize=False)  # -> Vector, Length

# ----
half_average_length = Data(division_2)
half_average_length_2 = Data(division)

# ---- group: Inputs
value_list = ValueList({"Specify the grid number manually": 1, "Grid number from calculation": 0}, selected="Grid number from calculation")
# Truss 2D & 3D
extent_x = Slider(7, range=1..40)
extent_y = Slider(6, range=1..40)

outline_curve = Curve(input_4_sided_curve)
end_depth_near_column_4 = Data(end_depth_near_column_2)
grid_size_2 = Data(grid_size)

# ---- group: Process
y_length_2 = Data(list_item_4.Item1)
subtraction = Subtraction(A=y_length_2, B=half_average_length_2)
division_3 = Division(A=y_length_2, B="2")
line_sdl_3 = LineSDL(Start=list_item_9.Item, Direction=vector_2pt_7.Vector, Length=division_3)
line_sdl_4 = LineSDL(Start=list_item_9.Item, Direction=vector_2pt_7.Vector, Length=half_average_length_2)
line_sdl_5 = LineSDL(Start=list_item_9.Item, Direction=vector_2pt_7.Vector, Length=subtraction)
line_sdl_6 = LineSDL(Start=list_item_9.Item, Direction=vector_2pt_7.Vector, Length=y_length_2)
move_5 = Move(Geometry=join_curves, Motion=line_sdl_3)  # -> Geometry, Transform
move_6 = Move(Geometry=join_curves, Motion=line_sdl_4)  # -> Geometry, Transform
move_7 = Move(Geometry=join_curves, Motion=line_sdl_5)  # -> Geometry, Transform
move_8 = Move(Geometry=x_curve_2, Motion=line_sdl_6)  # -> Geometry, Transform
entwine_5 = Entwine(Branch00=x_curve_2, Branch01=move_5.Geometry, Branch02=move_8.Geometry, FlattenInputs=True)  # -> flatten(Result)
entwine_6 = Entwine(Branch00=x_curve_2, Branch01=move_6.Geometry, Branch02=move_7.Geometry, Branch03=move_8.Geometry, FlattenInputs=True)  # -> flatten(Result)

x_length_2 = Data(list_item_4.Item)
subtraction_2 = Subtraction(A=x_length_2, B=half_average_length)
division_4 = Division(A=x_length_2, B="2")
line_sdl_7 = LineSDL(Start=list_item_10.Item, Direction=vector_2pt_8.Vector, Length=division_4)
line_sdl_8 = LineSDL(Start=list_item_10.Item, Direction=vector_2pt_8.Vector, Length=half_average_length)
line_sdl_9 = LineSDL(Start=list_item_10.Item, Direction=vector_2pt_8.Vector, Length=subtraction_2)
line_sdl_10 = LineSDL(Start=list_item_10.Item, Direction=vector_2pt_8.Vector, Length=x_length_2)
move_9 = Move(Geometry=join_curves_2, Motion=line_sdl_7)  # -> Geometry, Transform
move_10 = Move(Geometry=join_curves_2, Motion=line_sdl_8)  # -> Geometry, Transform
move_11 = Move(Geometry=join_curves_2, Motion=line_sdl_9)  # -> Geometry, Transform
move_12 = Move(Geometry=y_curve, Motion=line_sdl_10)  # -> Geometry, Transform
entwine_7 = Entwine(Branch00=y_curve, Branch01=move_9.Geometry, Branch02=move_12.Geometry, FlattenInputs=True)  # -> flatten(Result)
entwine_8 = Entwine(Branch00=y_curve, Branch01=move_10.Geometry, Branch02=move_11.Geometry, Branch03=move_12.Geometry, FlattenInputs=True)  # -> flatten(Result)

surface_base = Geometry(outline_curve)
grid_size_3 = Data(grid_size_2)
negative_8 = Negative(Value=grid_size_3)
cluster = Cluster(extent_x=extent_x, extent_y=extent_y, input_gate=value_list, surface_base=surface_base, grid_size=grid_size_3)  # -> X, Y, cells, points
offset_curve_2 = OffsetCurve(Curve=outline_curve, Distance=expr("x*2", negative_8), Corners=1)

data_2 = Data(cluster.cells)
area_2 = Area(Geometry=data_2)  # -> Area, Centroid
geometry_5 = Geometry(offset_curve_2)
point_in_curve = PointInCurve(Point=area_2.Centroid, Curve=geometry_5)  # -> Relationship, Point
straight_truss_cells = CullPattern(List=data_2, CullPattern=point_in_curve.Relationship)

boundary_surfaces = BoundarySurfaces(Edges=flatten(straight_truss_cells))
brep_join = BrepJoin(Breps=boundary_surfaces)  # -> Breps, Closed
point_in_curve_2 = PointInCurve(Point=cluster.points, Curve=brep_join.Breps)  # -> Relationship, Point
straight_truss_cells_2 = CullPattern(List=cluster.points, CullPattern=point_in_curve_2.Relationship)

# ---- group: Output
stream_filter_3 = StreamFilter(Gate=gate, Stream0=entwine_5, Stream1=entwine_5, Stream2=entwine_6)
stream_filter_4 = StreamFilter(Gate=gate_2, Stream0=entwine_7, Stream1=entwine_7, Stream2=entwine_8)
network_surface_2 = NetworkSurface(CurvesU=simplify(flatten(stream_filter_3)), CurvesV=simplify(flatten(stream_filter_4)), Continuity=2)

# ---- group: Process
data_3 = Data(straight_truss_cells)
surface_geometry = Geometry(network_surface_2)
area_3 = Area(Geometry=data_3)  # -> Area, Centroid
explode_3 = Explode(Curve=data_3, Recursive=True)  # -> Segments, Vertices
project_point = ProjectPoint(Point=area_3.Centroid, Direction=Vector(0, 0, -1), Geometry=surface_geometry)  # -> Point, Index
flip_matrix = FlipMatrix(Data=project_point.Point)
list_item_11 = ListItem(List=explode_3.Vertices, Index=0, Wrap=True)  # -> Item, Item1, Item2, Item3
geometry_6 = Geometry(project_point.Point)
polyline = PolyLine(Vertices=project_point.Point, Closed=False)
polyline_2 = PolyLine(Vertices=flip_matrix, Closed=False)
shift_paths = ShiftPaths(Data=list_item_11.Item, Offset=-1)
shift_paths_2 = ShiftPaths(Data=list_item_11.Item1, Offset=-1)
shift_paths_3 = ShiftPaths(Data=list_item_11.Item2, Offset=-1)
shift_paths_4 = ShiftPaths(Data=list_item_11.Item3, Offset=-1)
shift_paths_5 = ShiftPaths(Data=explode_3.Segments, Offset=-1)
line_5 = Line(StartPoint=simplify(shift_paths), EndPoint=geometry_6)
line_6 = Line(StartPoint=simplify(shift_paths_2), EndPoint=geometry_6)
line_7 = Line(StartPoint=simplify(shift_paths_3), EndPoint=geometry_6)
line_8 = Line(StartPoint=simplify(shift_paths_4), EndPoint=geometry_6)
end_points_13 = EndPoints(Curve=polyline)  # -> Start, End
end_points_14 = EndPoints(Curve=polyline_2)  # -> Start, End
merge_9 = Merge(Data1=line_5, Data2=line_6, Data3=line_7, Data4=line_8, Data5=shift_paths_5, Data6=polyline, Data7=polyline_2)
data_4 = Data(merge_9)

flip_matrix_2 = FlipMatrix(Data=straight_truss_cells_2)
polyline_3 = PolyLine(Vertices=straight_truss_cells_2, Closed=False)  # -> flatten(Polyline)
polyline_4 = PolyLine(Vertices=flip_matrix_2, Closed=False)  # -> flatten(Polyline)
null_item = NullItem(Item=polyline_3)  # -> NullFlags, InvalidFlags, Description
null_item_2 = NullItem(Item=polyline_4)  # -> NullFlags, InvalidFlags, Description
cull_pattern_9 = CullPattern(List=polyline_3, CullPattern=invert(null_item.NullFlags))
cull_pattern_10 = CullPattern(List=polyline_4, CullPattern=invert(null_item_2.NullFlags))
list_item_12 = ListItem(List=cull_pattern_9, Index=0, Wrap=True)  # -> Item1, Item
list_item_13 = ListItem(List=cull_pattern_10, Index=0, Wrap=True)  # -> Item1, Item
geometry_7 = Geometry(list_item_12.Item1)
geometry_8 = Geometry(list_item_12.Item)
geometry_9 = Geometry(list_item_13.Item1)
geometry_10 = Geometry(list_item_13.Item)

flip_matrix_3 = FlipMatrix(Data=cluster.points)
polyline_5 = PolyLine(Vertices=cluster.points, Closed=False)  # -> flatten(Polyline)
polyline_6 = PolyLine(Vertices=flip_matrix_3, Closed=False)  # -> flatten(Polyline)
null_item_3 = NullItem(Item=polyline_5)  # -> NullFlags, InvalidFlags, Description
null_item_4 = NullItem(Item=polyline_6)  # -> NullFlags, InvalidFlags, Description
cull_pattern_11 = CullPattern(List=polyline_5, CullPattern=invert(null_item_3.NullFlags))
cull_pattern_12 = CullPattern(List=polyline_6, CullPattern=invert(null_item_4.NullFlags))
list_item_14 = ListItem(List=cull_pattern_11, Index=0, Wrap=True)  # -> Item1, Item
list_item_15 = ListItem(List=cull_pattern_12, Index=0, Wrap=True)  # -> Item1, Item
geometry_11 = Geometry(list_item_14.Item1)
geometry_12 = Geometry(list_item_14.Item)
geometry_13 = Geometry(list_item_15.Item)
geometry_14 = Geometry(list_item_15.Item1)

# ---- group: Output
ceiling_depth_2 = Data(ceiling_depth)
unit_z_7 = UnitZ(Factor=ceiling_depth_2)
negative_9 = Negative(Value=unit_z_7)
move_13 = Move(Geometry=network_surface_2, Motion=negative_9)  # -> Geometry, Transform
ceiling_surface = Geometry(move_13.Geometry)

# Roof and Ceiling 3D
roof_depth_2 = Data(roof_depth)
unit_z_8 = UnitZ(Factor=roof_depth_2)
input_4_sided_curve_2 = Curve(input_4_sided_curve)
extrude = Extrude(Base=input_4_sided_curve_2, Direction=unit_z_8)
cap_holes = CapHoles(Brep=extrude)
roof_brep = Geometry(cap_holes)

# ---- group: Process
cluster_2 = Cluster_3(curve=geometry_9, curve_2=geometry_14)
cluster_3 = Cluster_3(curve=geometry_10, curve_2=geometry_13)
cluster_4 = Cluster_3(curve=geometry_7, curve_2=geometry_11)
cluster_5 = Cluster_3(curve=geometry_8, curve_2=geometry_12)
merge_10 = Merge(Data1=cluster_2, Data2=cluster_3, Data3=cluster_4, Data4=cluster_5)

cluster_6 = Cluster_2(item=end_points_13.Start, geometry=surface_geometry, curve=geometry_10)
cluster_7 = Cluster_2(item=end_points_13.End, geometry=surface_geometry, curve=geometry_9)
cluster_8 = Cluster_2(item=end_points_14.Start, geometry=surface_geometry, curve=geometry_8)
cluster_9 = Cluster_2(item=end_points_14.End, geometry=surface_geometry, curve=geometry_7)
merge_11 = Merge(Data1=cluster_6, Data2=cluster_7, Data3=cluster_8, Data4=cluster_9)

merge_12 = Merge(Data1=flatten(data_4), Data2=flatten(merge_11))
truss_lines = Data(merge_12)

# ----
geometry_15 = Geometry(merge_10)

# ---- group: Process
pipe = Pipe(Curve=data_4, Radius=truss_member_size, Caps="1")
pipe_2 = Pipe(Curve=merge_11, Radius=truss_member_size, Caps="1")

merge_13 = Merge(Data1=pipe, Data2=pipe_2)  # -> flatten(Result)
truss_3d = Geometry(merge_13)

# ---- group: User_control
# Bake Atrributes
boolean_toggle = BooleanToggle(False)
roof_number = Slider(1, range=1..11)

# ---- group: Ceiling
concatenate = Concatenate(FragmentA="Ceiling_", FragmentB=roof_number)
define_layer = DefineLayer(Name=concatenate)
create_modify_layers = CreateModifyLayers(LayerName=define_layer, DeleteLayer=False, enableFullPath=False)  # -> LayerNames, LayerFullPath
createattributes = CreateAttributes(LayerName=create_modify_layers.LayerNames, enableFullPath=False)
bake_geometry = BakeGeometry(Bake=boolean_toggle, Geometry=ceiling_surface, Attributes=createattributes, DeleteOldBakes=False, PreserveTrees=False)

# ---- group: Roof
concatenate_2 = Concatenate(FragmentA="Roof_", FragmentB=roof_number)
define_layer_2 = DefineLayer(Name=concatenate_2)
create_modify_layers_2 = CreateModifyLayers(LayerName=define_layer_2, DeleteLayer=False, enableFullPath=False)  # -> LayerNames, LayerFullPath
createattributes_2 = CreateAttributes(LayerName=create_modify_layers_2.LayerNames, enableFullPath=False)
bake_geometry_2 = BakeGeometry(Bake=boolean_toggle, Geometry=roof_brep, Attributes=createattributes_2, DeleteOldBakes=False, PreserveTrees=False)

# ---- group: Truss
concatenate_3 = Concatenate(FragmentA="Truss_", FragmentB=roof_number)
define_layer_3 = DefineLayer(Name=concatenate_3)
create_modify_layers_3 = CreateModifyLayers(LayerName=define_layer_3, DeleteLayer=False, enableFullPath=False)  # -> LayerNames, LayerFullPath
createattributes_3 = CreateAttributes(LayerName=create_modify_layers_3.LayerNames, enableFullPath=False)
bake_geometry_3 = BakeGeometry(Bake=boolean_toggle, Geometry=truss_3d, Attributes=createattributes_3, DeleteOldBakes=False, PreserveTrees=False)

# ---- group: Process
number_slider_3 = Slider(90, range=0..100)
perp_frame_3 = PerpFrame(Curve=reparameterize(geometry_15), Parameter="1")
# Beam  2D & 3D
perp_frame_4 = PerpFrame(Curve=reparameterize(geometry_15), Parameter="0")
rotate = Rotate(Geometry=perp_frame_3, Angle=degrees(number_slider_3), Plane=perp_frame_3)  # -> Geometry, Transform
point = Point(perp_frame_4)
project_point_2 = ProjectPoint(Point=point, Direction=Vector(0, 0, -1), Geometry=surface_geometry)  # -> Point, Index
rotate_2 = Rotate(Geometry=perp_frame_4, Angle=degrees(number_slider_3), Plane=perp_frame_3)  # -> Geometry, Transform
distance_2 = Distance(PointA=point, PointB=project_point_2.Point)

# ---- group: Inputs
truss_breadth_at_ends_2 = Data(truss_breadth_at_ends)
web_and_flange_thickness_2 = Data(web_and_flange_thickness)
truss_depth_at_ends_2 = Data(truss_depth_at_ends)

# ---- group: Process
ggprofileibeam = GgProfileIBeam(
    Depth=truss_depth_at_ends_2,
    Breadth=truss_breadth_at_ends_2,
    Web=web_and_flange_thickness_2,
    Flange=web_and_flange_thickness_2)
data_5 = Data(truss_breadth_at_ends_2)
data_6 = Data(truss_depth_at_ends_2)
dom_3 = Domain(DomainStart=expr("-x/2", data_6), DomainEnd=expr("x/2", data_6))
dom_4 = Domain(DomainStart=expr("-x/2", data_5), DomainEnd=expr("x/2", data_5))
radius_of_truss_members = Data(truss_member_size)
rectangle_2 = Rectangle(Plane=PlaneXY(0, 0, 0), XSize=dom_4, YSize=dom_3, Radius=0)  # -> Rectangle, Length
curve = Curve(ggprofileibeam)

multiplication = Multiplication(A=radius_of_truss_members, B="2")
addition = Addition(A=distance_2, B=multiplication)

# ---- group: Inputs
truss_lines_2 = Data(truss_lines)
beam_lines = Geometry(geometry_15)

curve_2 = Curve([<curve referenced from the Rhino model> x4])

# ---- group: Process
ggprofileibeam_2 = GgProfileIBeam(Depth=addition, Breadth=truss_breadth_at_ends_2, Web=web_and_flange_thickness_2, Flange=web_and_flange_thickness_2)
division_5 = Division(A=addition, B="2")
curve_3 = Curve(ggprofileibeam_2)
subtraction_3 = Subtraction(A=division_5, B=radius_of_truss_members)
bounding_rectangle = BoundingRectangle(Geometry=curve_3, Plane=PlaneXY(0, 0, 0), Axis=0, Slide=0, Union=True)  # -> Bounding, DimensionX, DimensionY
unit_z_9 = UnitZ(Factor=subtraction_3)
orient = Orient(Geometry=curve_3, Source=bounding_rectangle.Bounding, Target=rotate_2.Geometry)  # -> Geometry, Transform
negative_10 = Negative(Value=unit_z_9)
move_14 = Move(Geometry=orient.Geometry, Motion=negative_10)  # -> Geometry, Transform

division_6 = Division(A=radius_of_truss_members, B="2")
division_7 = Division(A=truss_depth_at_ends_2, B="2")
subtraction_4 = Subtraction(A=division_7, B=division_6)
unit_z_10 = UnitZ(Factor=subtraction_4)
orient_2 = Orient(Geometry=curve, Source=rectangle_2.Rectangle, Target=rotate.Geometry)  # -> Geometry, Transform
negative_11 = Negative(Value=unit_z_10)
move_15 = Move(Geometry=orient_2.Geometry, Motion=negative_11)  # -> Geometry, Transform

# ---- group: Karamba_analysis
cross_section_karamba3d = CrossSectionKaramba3D(
    FamilyNameOfCrossSection="DefaultCroSec",
    Height_cm=9.6,
    UpperFlangeWidth_cm=10,
    LowerFlangeWidth_cm=10,
    UpperFlangeThickness_cm=0.8,
    LowerFlangeThickness_cm=0.8,
    WebThickness_cm=0.5,
    FilletRadius_cm=0,
    mode="I")
# Structural Analysis
cross_section_karamba3d_2 = CrossSectionKaramba3D(FamilyNameOfCrossSection="DefaultCroSec", Diameter_cm=11.43, WallThickness_cm=0.4, mode="Circular Hollow")

negative_12 = Negative(Value=Slider(1, range=0..1))
unit_z_11 = UnitZ(Factor=negative_12)
loads_karamba3d = LoadsKaramba3D(Vector=unit_z_11, LCase="0", mode="Gravity")

line_to_beam_karamba3d = LineToBeamKaramba3D(
    Line=truss_lines_2,
    CrossSection=cross_section_karamba3d_2,
    New=True,
    Remove=True,
    LimitDistance_m=0.005,
    Bending=True,
    SetBucklingLength=True,
    ToPolylineMaxAngle=0.03,
    ToPolylineTolerance=0.01,
    ToPolylineMinEdgeLength=0.25)  # -> Element, Points, Info
line_to_beam_karamba3d_2 = LineToBeamKaramba3D(
    Line=beam_lines,
    CrossSection=cross_section_karamba3d,
    New=True,
    Remove=True,
    LimitDistance_m=0.005,
    Bending=True,
    SetBucklingLength=True,
    ToPolylineMaxAngle=0.03,
    ToPolylineTolerance=0.01,
    ToPolylineMinEdgeLength=0.25)  # -> Element, Points, Info
merge_14 = Merge(Data1=line_to_beam_karamba3d.Element, Data2=line_to_beam_karamba3d_2.Element)

point_2 = Point(line_to_beam_karamba3d.Points)
point_in_curves = PointInCurves(Point=point_2, Curves=curve_2)  # -> Relationship, Index, Point
cull_pattern_13 = CullPattern(List=point_2, CullPattern=point_in_curves.Relationship)
support_karamba3d = SupportKaramba3D(PosInd=cull_pattern_13, menu=[buttons(on, on, on, off, off, off)])

# ---- group: Output
merge_15 = Merge(Data1=simplify(graft(move_14.Geometry)), Data2=simplify(graft(move_15.Geometry)))
loft = Loft(Curves=merge_15, Options={Adjust=False, Closed=False, LoftEnds=0, LoftSimp=0, LoftType=0, Rebuild=10, Refit=0.01})
cap_holes_2 = CapHoles(Brep=loft)

# ---- group: Beam
concatenate_4 = Concatenate(FragmentA="Beam_", FragmentB=roof_number)
define_layer_4 = DefineLayer(Name=concatenate_4)
create_modify_layers_4 = CreateModifyLayers(LayerName=define_layer_4, DeleteLayer=False, enableFullPath=False)  # -> LayerNames, LayerFullPath
createattributes_4 = CreateAttributes(LayerName=create_modify_layers_4.LayerNames, enableFullPath=False)
bake_geometry_4 = BakeGeometry(
    Bake=boolean_toggle,
    Geometry=flatten(cap_holes_2),
    Attributes=createattributes_4,
    DeleteOldBakes=False,
    PreserveTrees=False)

# ---- group: Karamba_analysis
assemble_model_karamba3d = AssembleModelKaramba3D(Elem=flatten(merge_14), Support=flatten(support_karamba3d), Load=loads_karamba3d, LimitDistance_m=0.005)  # -> Model, Info, Mass_kg, CenterOfGravity, LoadCaseNames

analyze_karamba3d = AnalyzeKaramba3D(Model=assemble_model_karamba3d.Model)  # -> CalculatedModel, MaximumDisplacement_cm, ResultingForceOfGravity_kN, ElasticEnergyChange_kNm

model_view_karamba3d = ModelViewKaramba3D(Model=analyze_karamba3d.CalculatedModel, ResultFactors=1, ResultCase=-1)  # -> Model, DeformedMesh, DeformedAxes, DeformedModel

beam_view_karamba3d = BeamViewKaramba3D(Model=model_view_karamba3d.Model)  # -> Model, MeshesOfRenderedBeams, DeformedBeamAxes, LegendColors, LegendTags

# ----
legend = Legend(Colour=beam_view_karamba3d.LegendColors, Tags=["One Fish", "Two Fish", "Red Fish", "Blue Fish"], LegendType=1)

# ==== cluster Cluster
surface_base = ClusterInput()
grid_size = ClusterInput()
explode = Explode(Curve=surface_base, Recursive=True)  # -> Segments, Vertices
input_gate = ClusterInput()
extent_y = ClusterInput()
extent_x = ClusterInput()
length = Length(Curve=explode.Segments)
list_item = ListItem(List=length, Index=0, Wrap=True)  # -> Item1, Item
division = Division(A=list_item.Item, B=grid_size)
division_2 = Division(A=list_item.Item1, B=grid_size)
stream_filter = StreamFilter(Gate=input_gate, Stream0=division, Stream1=extent_x)
stream_filter_2 = StreamFilter(Gate=input_gate, Stream0=division_2, Stream1=extent_y)
rectangular = Rectangular(Plane=surface_base, SizeX=grid_size, SizeY=grid_size, ExtentX=stream_filter, ExtentY=stream_filter_2)  # -> Cells, Points
X = ClusterOutput(stream_filter)
Y = ClusterOutput(stream_filter_2)
cells = ClusterOutput(rectangular.Cells)
points = ClusterOutput(rectangular.Points)

# ==== cluster Cluster_2
item = ClusterInput()
geometry = ClusterInput()
curve = ClusterInput()
explode = Explode(Curve=curve, Recursive=True)  # -> Segments, Vertices
null_item = NullItem(Item=item)  # -> NullFlags, InvalidFlags, Description
project = Project(Curve=explode.Segments, Brep=geometry, Direction=Vector(0, 0, 1))
cull_pattern = CullPattern(List=item, CullPattern=invert(null_item.NullFlags))
curve_middle = CurveMiddle(Curve=project)
project_point = ProjectPoint(Point=explode.Vertices, Direction=Vector(0, 0, -1), Geometry=geometry)  # -> Point, Index
closest_point = ClosestPoint(Point=simplify(graft(cull_pattern)), Cloud=flatten(curve_middle))  # -> ClosestPoint, CPIndex, Distance
line = Line(StartPoint=explode.Vertices, EndPoint=project_point.Point)
line_2 = Line(StartPoint=cull_pattern, EndPoint=closest_point.ClosestPoint)
merge = Merge(Data1=project, Data2=line_2, Data3=line)  # -> flatten(Result)
result = ClusterOutput(merge)

# ==== cluster Cluster_3
curve = ClusterInput()
explode = Explode(Curve=curve, Recursive=True)  # -> Segments, Vertices
curve_2 = ClusterInput()
curve_closest_point = CurveClosestPoint(Point=explode.Vertices, Curve=curve_2)  # -> Point, Parameter, Distance
line = Line(StartPoint=explode.Vertices, EndPoint=curve_closest_point.Point)
line_2 = ClusterOutput(line)
